# Grasshopper definition 01_Ray shoot object indentification.gh (Grasshopper 1.0.7)

python = GhPythonScript()  # -> room_boundaries; inputs room_wall_lines: tree of Line; disabled
# ---------- python: Python ----------
import rhinoscriptsyntax as rs
import ghpythonlib.components as gh
from Rhino.Geometry import PolyCurve
from Rhino.Geometry import Point

def dataTreeToList(aTree):
    from Grasshopper import DataTree
    from Grasshopper.Kernel.Data import GH_Path
    theList = []
    for i in range(aTree.BranchCount ):
        thisListPart = []
        thisBranch = aTree.Branch(i)
        for j in range(len(thisBranch)):
            thisListPart.append( thisBranch[j] )
        theList.append(thisListPart)
    return theList

def raggedListToDataTree(raggedList):
    from Grasshopper import DataTree
    from Grasshopper.Kernel.Data import GH_Path
    rl = raggedList
    result = DataTree[object]()
    for i in range(len(rl)):
        temp = []
        for j in range(len(rl[i])):
            temp.append(rl[i][j])
        #print i, " - ",temp
        path = GH_Path(i)
        result.AddRange(temp, path)
    return result

def join_curves(curves):
    curves = gh.JoinCurves(curves)
    curves = gh.ExtendCurve(curves, 0, threshold, threshold)
    intersections, i_a, i_b, p_a, p_b = gh.MultipleCurves(curves)
    curve_dict = {}
    
    for intersection in intersections:
        curve_dict{}
        gh.Shatter(c1,[0.1,0.8])
    for 
    

# --------------------------------------------------------------------------#
# Sammenlign alle endepunkters afstand
# Forbind enedepunkterne startende med de tætteste.

    # Fjern punkterne når de er blevet forbundet.


# --------------------------------------------------------------------------#
room_wall_lines = dataTreeToList(room_wall_lines)


room_boundaries = []
for curves in room_wall_lines:
    if type(curves) in [list,tuple]:
        boundary_line = join_curves(curves)
    room_boundaries.append(boundary_line)

#Ready output
#room_boundaries = raggedListToDataTree(room_boundaries)



"""
    for i, curve in enumerate(curves):
        other_curves = curves[:i]+curves[i+1:]
        
        intersections_on_curve = gh.MultipleCurves(curve, obstacles=other_curves)
        gh.CollisionOneXMany(
        print(intersections_on_curve)
        for other_curve in curves:
            if curve != other_curve:
                point, param_a, param_b = gh.CurveXCurve(curve,other_curve)
                if point:
                    intersections_on_curve.append(point)
        intersections.append(intersections_on_curve)
    print(intersections)"""
# ---------- end python ----------
# Number of Rays
number_of_rays = Slider(8, range=0..100)
niklas_perfekte_model = Curve([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])
anders_fejlmodel = Curve([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])
# Building Mesh
crv = Curve(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)
# Ray-wall distance threshold
number_slider = Slider(250, range=100..500)
# Room height
number_slider_2 = Slider(3000, range=1000..5000)
# Point Grid Cell Size
number_slider_3 = Slider(1000, range=100..5000)
wall_lines = Curve(niklas_perfekte_model)
wall_lines_2 = Curve(wall_lines)

# ----
# Clean up
# Simplify and extend
crv_2 = Curve(reparameterize(wall_lines_2))
redpline = Reduce(Polyline=crv_2, Tolerance=0.1)  # -> Polyline, Reduction
duplcrvs = RemoveDuplicateCurves(C=redpline.Polyline, plusFlipped=Toggle(False), onlyOverlapped=Toggle(True))  # -> readMe, UC, DC, DI; inputs C: list of Curve, plusFlipped: Boolean, onlyOverlapped: Boolean
# ---------- duplcrvs: Python ----------
#********************************************************************************************#
#********* Select duplicate curves **********************************************************#
#********* by Djordje Spasic ****************************************************************#
#********* issworld2000@yahoo.com 16-May-2014 ***********************************************#

"""
Removes all duplicate curves, whether they're positioned on top of each other or scattered around.
Supports any kind of curves (lines, polyline, rectangles, circles, arcs, freeform curves, helix... ).
Supports both lists and datatrees as inputs - and removes different types of curve duplicates from 
the same list or branch:

    Input:
        C: The curves you wish to "clean" from duplicates
        tol: Tolerances. If not supplied, Rhino's Model absolute tolerances will be used
        plusFlipped: This will clean the curves of the same shape, but flipped
        onlyOverlapped: Only equal curves positioned on top of each other will be considered, not those scattered around
    Output:
        readMe!: ...
        UC: Unique curves
        DC: Duplicate curves
        DI: Duplicate indices
"""

ghenv.Component.Name = "Remove duplicate curves"
ghenv.Component.NickName = "duplCrvs"
ghenv.Component.Category = "Milkbox"
ghenv.Component.SubCategory = "Curves"
try: ghenv.Component.AdditionalHelpFromDocStrings = "1"
except: pass

import scriptcontext as sc
import Rhino

def cullDuplicateCurves(_crvs, _t, _tol, _flippedCrvs, _overlapped):
    duplCrvs = []
    nc_objs = [crv.ToNurbsCurve() for crv in _crvs]
    indx = []
    for i in range(len(nc_objs)):
        for k in range(len(nc_objs)):
            if (i != k) and (i not in indx) and (k not in indx) and (round(nc_objs[i].GetLength(), 3) == round(nc_objs[k].GetLength(), 3)):
                    if nc_objs[i].EpsilonEquals(nc_objs[k], _t):
                        crv1TVst = nc_objs[i].TangentAt(nc_objs[i].Domain[0])
                        crv1CVst = nc_objs[i].CurvatureAt(nc_objs[i].Domain[0])
                        crv1t1 = round( nc_objs[i].NormalizedLengthParameter( 0.33, Rhino.Geometry.Interval(0, nc_objs[i].GetLength()) )[1], 3 )
                        crv1CVmid1 = nc_objs[i].CurvatureAt(crv1t1)
                        crv1t2 = round( nc_objs[i].NormalizedLengthParameter( 0.66, Rhino.Geometry.Interval(0, nc_objs[i].GetLength()) )[1], 3 )
                        crv1CVmid2 = nc_objs[i].CurvatureAt(crv1t2)
                        crv1CVend = nc_objs[i].CurvatureAt(nc_objs[i].Domain[1])
                        crv1TVend = nc_objs[i].TangentAt(nc_objs[i].Domain[1])

                        crv2TVst = nc_objs[k].TangentAt(nc_objs[k].Domain[0])
                        crv2CVst = nc_objs[k].CurvatureAt(nc_objs[k].Domain[0])
                        crv2t1 = round( nc_objs[k].NormalizedLengthParameter( 0.33, Rhino.Geometry.Interval(0, nc_objs[k].GetLength()) )[1], 3 )
                        crv2CVmid1 = nc_objs[i].CurvatureAt(crv2t1)
                        crv2t2 = round( nc_objs[k].NormalizedLengthParameter( 0.66, Rhino.Geometry.Interval(0, nc_objs[k].GetLength()) )[1], 3 )
                        crv2CVmid2 = nc_objs[i].CurvatureAt(crv2t2)
                        crv2CVend = nc_objs[k].CurvatureAt(nc_objs[k].Domain[1])
                        crv2TVend = nc_objs[k].TangentAt(nc_objs[k].Domain[1])

                        if _flippedCrvs == False and _overlapped == False:
                            if ( crv1TVst.EpsilonEquals(crv2TVst, _tol) and crv1CVst.EpsilonEquals(crv2CVst, _tol) and crv1CVmid1.EpsilonEquals(crv2CVmid1, _tol) and crv1CVmid2.EpsilonEquals(crv2CVmid2, _tol) and crv1CVend.EpsilonEquals(crv2CVend, _tol) and crv1TVend.EpsilonEquals(crv2TVend, _tol) ):
                                indx.append(i)
                        elif _flippedCrvs == True and _overlapped == False:
                            crv2TVstR = Rhino.Geometry.Vector3d(crv2TVst)
                            crv2TVstR.Reverse()
                            crv2TVendR = Rhino.Geometry.Vector3d(crv2TVend)
                            crv2TVendR.Reverse()
    
                            crv2R = nc_objs[k].Duplicate()
                            crv2R.Reverse()
                            crv2TVstRR = crv2R.TangentAt(crv2R.Domain[0])
                            crv2CVstR = crv2R.CurvatureAt(crv2R.Domain[0])
                            crv2t1R = round( crv2R.NormalizedLengthParameter( 0.33, Rhino.Geometry.Interval(0, crv2R.GetLength()) )[1], 3 )
                            crv2CVmid1R = crv2R.CurvatureAt(crv2t1R)
                            crv2t2R = round( crv2R.NormalizedLengthParameter( 0.66, Rhino.Geometry.Interval(0, crv2R.GetLength()) )[1], 3 )
                            crv2CVmid2R = crv2R.CurvatureAt(crv2t2R)
                            crv2CVendR = crv2R.CurvatureAt(crv2R.Domain[1])
                            crv2TVendRR = crv2R.TangentAt(crv2R.Domain[1])
                            if ( crv1TVst.EpsilonEquals(crv2TVst, _tol) and crv1CVst.EpsilonEquals(crv2CVst, _tol) and crv1CVmid1.EpsilonEquals(crv2CVmid1, _tol) and crv1CVmid2.EpsilonEquals(crv2CVmid2, _tol) and crv1CVend.EpsilonEquals(crv2CVend, _tol) and crv1TVend.EpsilonEquals(crv2TVend, _tol) )\
                            or ( crv1TVst.EpsilonEquals(crv2TVendR, _tol) and crv1CVst.EpsilonEquals(crv2CVend, _tol) and crv1CVmid1.EpsilonEquals(crv2CVmid2, _tol) and crv1CVmid2.EpsilonEquals(crv2CVmid1, _tol) and crv1CVend.EpsilonEquals(crv2CVst, _tol) and crv1TVend.EpsilonEquals(crv2TVstR, _tol) )\
                            or ( crv1TVst.EpsilonEquals(crv2TVstRR, _tol) and crv1CVst.EpsilonEquals(crv2CVstR, _tol) and crv1CVmid1.EpsilonEquals(crv2CVmid1R, _tol) and crv1CVmid2.EpsilonEquals(crv2CVmid2R, _tol) and crv1CVend.EpsilonEquals(crv2CVendR, _tol) and crv1TVend.EpsilonEquals(crv2TVendRR, _tol) ):
                                indx.append(i)
                        elif _flippedCrvs == False and _overlapped == True:
                            t1 = (nc_objs[i].Domain[0]+nc_objs[i].Domain[1])/2
                            midCrv1 = nc_objs[i].PointAt(t1)
                            t2 = (nc_objs[k].Domain[0]+nc_objs[k].Domain[1])/2
                            midCrv2 = nc_objs[k].PointAt(t2)
                            if ( midCrv1.EpsilonEquals(midCrv2, _tol) and crv1TVst.EpsilonEquals(crv2TVst, _tol) and crv1CVst.EpsilonEquals(crv2CVst, _t) and crv1CVmid1.EpsilonEquals(crv2CVmid1, _tol) and crv1CVmid2.EpsilonEquals(crv2CVmid2, _tol) and crv1CVend.EpsilonEquals(crv2CVend, _tol) and crv1TVend.EpsilonEquals(crv2TVend, _tol) ):
                                indx.append(i)
                        elif _flippedCrvs == True and _overlapped == True:
                            crv2TVstR = Rhino.Geometry.Vector3d(crv2TVst)
                            crv2TVstR.Reverse()
                            crv2TVendR = Rhino.Geometry.Vector3d(crv2TVend)
                            crv2TVendR.Reverse()
    
                            crv2R = nc_objs[k].Duplicate()
                            crv2R.Reverse()
                            crv2TVstRR = crv2R.TangentAt(crv2R.Domain[0])
                            crv2CVstR = crv2R.CurvatureAt(crv2R.Domain[0])
                            crv2t1R = round( crv2R.NormalizedLengthParameter( 0.33, Rhino.Geometry.Interval(0, crv2R.GetLength()) )[1], 3 )
                            crv2CVmid1R = crv2R.CurvatureAt(crv2t1R)
                            crv2t2R = round( crv2R.NormalizedLengthParameter( 0.66, Rhino.Geometry.Interval(0, crv2R.GetLength()) )[1], 3 )
                            crv2CVmid2R = crv2R.CurvatureAt(crv2t2R)
                            crv2CVendR = crv2R.CurvatureAt(crv2R.Domain[1])
                            crv2TVendRR = crv2R.TangentAt(crv2R.Domain[1])

                            t1 = (nc_objs[i].Domain[0]+nc_objs[i].Domain[1])/2
                            midCrv1 = nc_objs[i].PointAt(t1)
                            t2 = (nc_objs[k].Domain[0]+nc_objs[k].Domain[1])/2
                            midCrv2 = nc_objs[k].PointAt(t2)
                            if ( midCrv1.EpsilonEquals(midCrv2, _tol) and crv1TVst.EpsilonEquals(crv2TVst, _tol) and crv1CVst.EpsilonEquals(crv2CVst, _t) and crv1CVmid1.EpsilonEquals(crv2CVmid1, _tol) and crv1CVmid2.EpsilonEquals(crv2CVmid2, _tol) and crv1CVend.EpsilonEquals(crv2CVend, _tol) and crv1TVend.EpsilonEquals(crv2TVend, _tol) )\
                            or ( midCrv1.EpsilonEquals(midCrv2, _tol) and crv1TVst.EpsilonEquals(crv2TVendR, _tol) and crv1CVst.EpsilonEquals(crv2CVend, _tol) and crv1CVmid1.EpsilonEquals(crv2CVmid2, _tol) and crv1CVmid2.EpsilonEquals(crv2CVmid1, _tol) and crv1CVend.EpsilonEquals(crv2CVst, _tol) and crv1TVend.EpsilonEquals(crv2TVstR, _tol) )\
                            or ( midCrv1.EpsilonEquals(midCrv2, _tol) and crv1TVst.EpsilonEquals(crv2TVstRR, _tol) and crv1CVst.EpsilonEquals(crv2CVstR, _tol) and crv1CVmid1.EpsilonEquals(crv2CVmid1R, _tol) and crv1CVmid2.EpsilonEquals(crv2CVmid2R, _tol) and crv1CVend.EpsilonEquals(crv2CVendR, _tol) and crv1TVend.EpsilonEquals(crv2TVendRR, _tol) ):
                                indx.append(i)
    crvsIndexes = range(len(_crvs))
    uniqCrvs = []
    for index in indx:
        duplCrvs.append(_crvs[index])
    for index2 in crvsIndexes:
        if index2 not in indx:
            uniqCrvs.append(_crvs[index2])

    if len(indx) > 0:
        print "Found %s duplicate curves" % len(indx)
        return [duplCrvs, indx, uniqCrvs]
    else:
        print "No duplicate curves found"
        return [[], [], C]

if not tol:
    tol = Rhino.RhinoDoc.ActiveDoc.ModelAbsoluteTolerance
if not plusFlipped:
    plusFlipped = True
if not onlyOverlapped:
    onlyOverlapped = False

if C:
    if len(C)>1:
        t = 100000000
        a = cullDuplicateCurves(C, t, tol, plusFlipped, onlyOverlapped)
        UC = a[2]
        DC = a[0]
        DI = a[1]
    else:
        UC = []
        DC = []
        DI = []
        print "ONLY ONE CURVE HAS BEEN INPUTTED."
else:
    print "INPUT PARAMETER \"C\" FAILED TO COLLECT CURVE DATA !!!"
# ---------- end duplcrvs ----------
redpline_2 = Reduce(Polyline=duplcrvs.UC, Tolerance=0.1)  # -> Polyline, Reduction
crv_3 = Curve(redpline_2.Polyline)

number_of_rays_2 = Number(number_of_rays)

# ----
# Cull small useless line pieces
number_slider_4 = Slider(500, range=0..1000)  # disabled
crv_4 = Curve()  # disabled
distance_threshold = Number(number_slider_4)  # disabled
python_2 = GhPythonScript(C=crv_4, t=distance_threshold)  # -> out, C; inputs C: list of Curve; disabled
# ---------- python_2: Python ----------
import rhinoscriptsyntax as rs
import Rhino.Geometry as rg
import ghpythonlib.components as gh
from Grasshopper import DataTree
from Grasshopper.Kernel.Data import GH_Path

EPS = 1e-2

def discard_small_ends(curves):
    # Reparametrize
    gh.CurveDomain(C,rg.Interval(0,1))
    #Create list of endpoints
    end_points = []
    for curve in curves:
        pt0 = curve.PointAt(0)
        pt1 = curve.PointAt(1)
        end_points.extend([pt0, pt1])
    # main check loop
    for i in range(len(curves)):
        # Check if curve is too short
        curve_length = curves[i].GetLength()
        if curve_length > t*1.01:
            yield curves[i]
        else:
            #Check if both endpoints are shared
            pt0 = end_points[i*2]
            pt1 = end_points[i*2+1]
            check_points = end_points[:i*2]+end_points[i*2+2:]
            _, _, d0 = gh.ClosestPoint(pt0,check_points)
            _, _, d1 = gh.ClosestPoint(pt1,check_points)
            if d0 < EPS and d1 < EPS:
                print(d0,d1)
                yield curves[i]
                #if (pt0 in check_points) and (pt1 in check_points):

# Discard small lengths
C_save = list(C)
C = list(discard_small_ends(C))
# ---------- end python_2 ----------
crv_5 = Curve(python_2.C)  # disabled

# ----
# Find Closest points
# that are not endpoints and are within the distance limit
crv_6 = Curve(crv_3)
end = EndPoints(Curve=crv_6)  # -> Start, End
crv_cp = CurveClosestPoint(Point=simplify(graft([end.Start, end.End])), Curve=reparameterize(crv_6))  # -> Point, Parameter, Distance
smaller = SmallerThan(FirstNumber=crv_cp.Distance, SecondNumber=Slider(200, range=0..1000))  # -> SmallerThan, OrEqualTo
smaller_2 = SmallerThan(FirstNumber=crv_cp.Parameter, SecondNumber="1e-3")  # -> SmallerThan, OrEqualTo
larger = LargerThan(FirstNumber=crv_cp.Parameter, SecondNumber="1-1e-3")  # -> LargerThan, OrEqualTo
or = GateOr(A=larger.LargerThan, B=smaller_2.SmallerThan)
not = GateNot(A=or)
parameters = Number(simplify(crv_cp.Parameter))
and = GateAnd(A=not, B=smaller.SmallerThan)  # -> simplify(Result)
path_mapper = PathMapper(and, source="{A}(B)", target="{B}(A)")
path_mapper_2 = PathMapper(parameters, source="{A}(B)", target="{B}(A)")
cull = CullPattern(List=simplify(path_mapper_2), CullPattern=simplify(path_mapper))
any = AnyTrue_2(values=path_mapper)  # -> flatten(any_true)
not_2 = GateNot(A=any)
shatter = Shatter(Curve=graft(crv_6), Parameters=cull)
cull_2 = CullPattern(List=simplify(crv_6), CullPattern=not_2)
shattered_curves = Curve(shatter)
curves_to_keep = Curve(cull_2)
merge = Merge(Data1=flatten(shattered_curves), Data2=flatten(curves_to_keep))  # -> flatten(Result)
crv_7 = Curve(merge)

path = ConstructPath(Indices=Slider(3, range=1..5))
boundary = BoundarySurfaces()
room_surfaces = Surface(boundary)

# ----
# Extrude
room_surfaces_2 = Surface(room_surfaces)
room_height = Number(number_slider_2)
Z = UnitZ(Factor=room_height)
boundary_2 = BoundarySurfaces(Edges=room_surfaces_2)
extr = Extrude(Base=boundary_2, Direction=Z)

# ----
# Extend lines
crv_8 = Curve(crv_7)
distance_threshold_2 = Number(Slider(400, range=0..1000))
python_3 = GhPythonScript(C=crv_8, t=distance_threshold_2)  # -> out, C, obstacles; inputs C: tree of Curve
# ---------- python_3: Python ----------
"""
Inputs:
    C   Wall curves
    t   Distance threshold
Outputs:
    C  Wall curves
"""
import rhinoscriptsyntax as rs
import Rhino.Geometry as rg
import ghpythonlib.components as gh
import ghpythonlib.treehelpers as ght
from Grasshopper import DataTree
from Grasshopper.Kernel.Data import GH_Path

EPS = 1e-1


def extend_to_collision(curve, obstacles):
    extensions = []
    if curve.IsPolyline():
        #Start point ray
        pnt0 = curve.PointAtStart
        tan0 = curve.TangentAtStart
        tan0.Reverse()
        ray0 = rg.Line(pnt0, tan0, 1)
        _, dist0, i0 = gh.IsoVistRay(ray0, t, obstacles)
        if i0 != -1:
#            print(pnt0, tan0, ray0, dist0)
            extensions.append(rg.LineCurve(rg.Line(pnt0, tan0, dist0)))
        
        #End Point ray
        pnt1 = curve.PointAtEnd
        tan1 = curve.TangentAtEnd
        ray1 = rg.Line(pnt1, tan1, 1)
        _, dist1, i1 = gh.IsoVistRay(ray1, t, obstacles)
        if i1 != -1:
            print(pnt1, tan1, ray1, dist1)
            print(obstacles)
            extensions.append(rg.LineCurve(rg.Line(pnt1, tan1, dist1)))

    return extensions




def clean_obstacles(curve, other_curves):
    oc = []
    for other_curve in other_curves:
        distances = [gh.Distance(curve.PointAtStart, other_curve.PointAtStart),
                     gh.Distance(curve.PointAtStart, other_curve.PointAtEnd),
                     gh.Distance(curve.PointAtEnd, other_curve.PointAtStart),
                     gh.Distance(curve.PointAtEnd, other_curve.PointAtEnd)]
        close = [True if d<=EPS else False for d in distances]
        if not any(close):
            oc.append(other_curve)
    return oc

C.Flatten()
curves = ght.tree_to_list(C)
all_extensions = []
for i, curve in enumerate(curves):
    obstacles = clean_obstacles(curve, curves)
    print(i, len(obstacles),"/",len(curves))
    curve_extensions = extend_to_collision(curve, obstacles)
    all_extensions.extend(curve_extensions)
curves.extend(all_extensions)

C = ght.list_to_tree(curves)
# ---------- end python_3 ----------
crv_9 = Curve(python_3.C)

# ----
# Simplify
crv_10 = Curve(crv_9)
redpline_3 = Reduce(Polyline=crv_10, Tolerance=0.1)  # -> Polyline, Reduction
explode = Explode(Curve=redpline_3.Polyline, Recursive=True)  # -> flatten(Segments), Vertices
crv_11 = Curve(explode.Segments)

wall_lines_3 = Curve(crv_11)
wall_lines_4 = Curve(wall_lines_3)

# ----
# Extreme points
bbox = BoundingBox(Content=wall_lines_4, Plane=PlaneXY(0, 0, 0), UnionBox=True)  # -> Box, Box_2
box = EvaluateBox(Box=bbox.Box, UParameter=1, VParameter=1, WParameter=1)  # -> Plane, Point, Include
debox = DeconstructBox(Box=bbox.Box)  # -> Plane, X, Y, Z
dedomain = DeconstructDomain(Domain=debox.X)  # -> Start, End
dedomain_2 = DeconstructDomain(Domain=debox.Y)  # -> Start, End
dedomain_3 = DeconstructDomain(Domain=debox.Z)  # -> Start, End
vlen = VectorLength(Vector=box.Point)
min_x = Number(dedomain.Start)
max_x = Number(dedomain.End)
min_y = Number(dedomain_2.Start)
max_y = Number(dedomain_2.End)
min_z = Number(dedomain_3.Start)
max_z = Number(dedomain_3.End)
longest_distance = Number(vlen)

# ----
# Point Grid
max_y_2 = Number(max_y)
min_y_2 = Number(min_y)
max_x_2 = Number(max_x)
min_x_2 = Number(min_x)
cell_size = Number(number_slider_3)
subtraction = Subtraction(A=min_y_2, B=cell_size)
subtraction_2 = Subtraction(A=min_x_2, B=cell_size)
subtraction_3 = Subtraction(A=max_x_2, B=min_x_2)
subtraction_4 = Subtraction(A=max_y_2, B=min_y_2)
xy = XYPlane(Origin=Point(0, 0, 0))
pt = ConstructPoint(XCoordinate=subtraction_2, YCoordinate=subtraction, ZCoordinate=0)
division = Division(A=subtraction_3, B=cell_size)
division_2 = Division(A=subtraction_4, B=cell_size)
round = Round(Number=division)  # -> Nearest, Floor, Ceiling
round_2 = Round(Number=division_2)  # -> Nearest, Floor, Ceiling
pl_origin = PlaneOrigin(Base=xy, Origin=pt)
addition = Addition(A=round.Ceiling, B=1)
addition_2 = Addition(A=round_2.Ceiling, B=1)
sqgrid = Square(Plane=pl_origin, Size=cell_size, ExtentX=addition, ExtentY=addition_2)  # -> Cells, Points
point_grid = Point(flatten(sqgrid.Points))

# ----
# Frasorterer punkter for tæt på vægge
distance_threshold_3 = Number(number_slider)
point_grid_2 = Point(point_grid)
wall_lines_5 = Line(wall_lines_3)
crv_cp_2 = CurveClosestPoint(Point=point_grid_2, Curve=graft(wall_lines_5))  # -> Point, Parameter, Distance
flip = FlipMatrix(Data=crv_cp_2.Distance)
sort = SortList(Keys=flip)  # -> Keys, ValuesA
item = ListItem(List=sort.Keys, Index=0, Wrap=True)  # -> flatten(Item)
larger_2 = LargerThan(FirstNumber=item, SecondNumber=distance_threshold_3)  # -> LargerThan, OrEqualTo
cull_3 = CullPattern(List=point_grid_2, CullPattern=larger_2.LargerThan)
cull_pattern = Boolean(larger_2.LargerThan)
point_grid_3 = Point(cull_3)

# ----
# Isovist
wall_lines_6 = Line(flatten(wall_lines_3))
number_of_rays_3 = Number(number_of_rays)
point_grid_4 = Point(point_grid_3)
ray_radius = Number(longest_distance)
ivist = IsoVist(Plane=simplify(point_grid_4), Count=number_of_rays_3, Radius=ray_radius, Obstacles=wall_lines_6)  # -> Points, Distance, Index
item_2 = ListItem(List=wall_lines_6, Index=ivist.Index, Wrap=False)
hit_wall_indices = Number(ivist.Index)
hit_distances = Number(ivist.Distance)
hit_points = Point(ivist.Points)
hit_walls = Line(item_2)

# ----
# Datasortering og rensning af "cullede" lister
# Cull pattern: Any ray distance below threshold
# Cull pattern: Any ray in list has not hit an object
hit_distances_2 = Number(hit_distances)
hit_wall_indices_2 = Number(hit_wall_indices)
hit_walls_2 = Line(item_2)
hit_points_2 = Point(hit_points)
distance_threshold_4 = Number(number_slider)
smaller_3 = SmallerThan(FirstNumber=hit_distances_2, SecondNumber=distance_threshold_4)  # -> SmallerThan, OrEqualTo
equals = Equality(FirstNumber=hit_wall_indices_2, SecondNumber="-1")  # -> Equality, Inequality
any_2 = AnyTrue(list_of_bools=equals.Equality)
any_3 = AnyTrue(list_of_bools=smaller_3.OrEqualTo)
not_3 = GateNot(A=any_2)
not_4 = GateNot(A=any_3)
and_2 = GateAnd(A=not_4, B=not_3)
cull_4 = CullPattern(List=hit_walls_2, CullPattern=and_2)  # -> simplify(List)
clean = CleanTree(RemoveNulls=True, RemoveInvalid=True, RemoveEmpty=True, Tree=cull_4)
python_4 = GhPythonScript(L=clean)  # -> L; inputs L: tree
# ---------- python_4: Python ----------
L.RenumberPaths()
# ---------- end python_4 ----------
hit_walls_3 = Line(python_4)

# ----
# Wall Normals
hit_walls_4 = Line(hit_walls_3)
point_grid_5 = Point(graft(point_grid_3))
end_2 = EndPoints(Curve=hit_walls_4)  # -> Start, End
Z_2 = UnitZ(Factor=1)
pl = ConstructPlane(Origin=end_2.Start, XAxis=hit_walls_4, YAxis=Z_2)
xprod = CrossProduct(VectorA=hit_walls_4, VectorB=Z_2, Unitize=False)  # -> Vector, Length
rev = Reverse(Vector=xprod.Vector)

repeat = RepeatData(Data=point_grid_5, Length=number_of_rays_2)

cp = PlaneClosestPoint(Point=repeat, Plane=pl)  # -> Point, UVPoint, Distance
smaller_4 = SmallerThan(FirstNumber=cp.Distance, SecondNumber="0")  # -> SmallerThan, OrEqualTo
p_n_c = PickNChoose(Pattern=smaller_4.SmallerThan, Stream0=xprod.Vector, Stream1=rev)
wall_normals = Vector(p_n_c)

# ----
# Sort into rooms
wall_normals_2 = Vector(wall_normals)
# Join room polylines
isovists_hits = Line(hit_walls_3)
python_5 = GhPythonScript(normals=wall_normals_2, isovists_walls=isovists_hits)  # -> out, a, b; inputs normals: tree of Vector3d, isovists_walls: tree of Line
# ---------- python_5: Python ----------
import rhinoscriptsyntax as rs
#import ghpythonlib.treehelpers as th
from Grasshopper import DataTree
from Grasshopper.Kernel.Data import GH_Path

def dataTreeToList(aTree):
    theList = []
    for i in range(aTree.BranchCount ):
        thisListPart = []
        thisBranch = aTree.Branch(i)
        for j in range(len(thisBranch)):
            thisListPart.append( thisBranch[j] )
        theList.append(thisListPart)
    return theList

def raggedListToDataTree(raggedList):
    rl = raggedList
    result = DataTree[object]()
    for i in range(len(rl)):
        temp = []
        for j in range(len(rl[i])):
            temp.append(rl[i][j])
        #print i, " - ",temp
        path = GH_Path(i)
        result.AddRange(temp, path)
    return result

normals = dataTreeToList(normals)
isovists_walls = dataTreeToList(isovists_walls)

room_sets = []
for i,walls in enumerate(isovists_walls):
#    print("iteration:",i, "Room Sets:",len(room_sets))
    room_set = set()
    for j,wall in enumerate(walls):
        room_set.add((wall,normals[i][j]))
    
    # If this is the first room
    if len(room_sets) <= 0:
        room_sets.append(room_set)
        continue
    
    # Go through existing sets
    for k in range(len(room_sets)):
        #Add if it fits
        intersections = len(room_sets[k].intersection(room_set))
        if intersections >= 3:
            room_sets[k] = room_sets[k].union(room_set)
#            print("Set match with length:",intersections)
            continue
        # Create new if it did not fit and end is reached
        if k == len(room_sets)-1:
            room_sets.append(room_set)

# Go through existing sets combining them if they have enough intersection
for i in range(len(room_sets)):
    for j in range(i):
        intersections = len(room_sets[i].intersection(room_sets[j]))
        if intersections >= 3:
            room_sets[i] = room_sets[i].union(room_sets[j])
            room_sets[j] = set()
room_sets = [x for x in room_sets if len(x)!=0]

# Ready output
a = []
b = []
for s in room_sets:
    set_normals = []
    set_lines = []
    for x in list(s):
        set_lines.append(x[0])
        set_normals.append(x[1])
    a.append(set_lines)
    b.append(set_normals)
a = raggedListToDataTree(a)
b = raggedListToDataTree(b)
# ---------- end python_5 ----------
wall_normals_3 = Vector(python_5.b)
wall_lines_7 = Line(python_5.a)

# ----
# Simplify and extend
wall_lines_8 = Line(wall_lines_7)
explode_2 = Explode(Curve=wall_lines_8, Recursive=True)  # -> Segments, Vertices
distance_threshold_5 = Number(Slider(500, range=0..1000))
ext = ExtendCurve(Curve=wall_lines_8, Type=0, Start=distance_threshold_5, End=distance_threshold_5)
crv_12 = Curve(ext)

redpline_4 = Reduce(Polyline=wall_lines_8, Tolerance=0.1)  # -> Polyline, Reduction
path_mapper_3 = PathMapper(explode_2.Segments, source="{A;B}", target="{A}(B)")
flip_2 = FlipCurve(Curve=hit_walls_4)  # -> Curve, Flag
p_n_c_2 = PickNChoose(Pattern=smaller_4.SmallerThan, Stream0=hit_walls_4, Stream1=flip_2.Curve)
redpline_5 = Reduce(Polyline=ext, Tolerance=0.1)  # -> Polyline, Reduction
pipe = Pipe(Curve=wall_lines_7, Radius=Slider(100, range=0..1000), Caps=0)
hit_walls_5 = Line(p_n_c_2)
branch = TreeBranch(Tree=crv_12, Path=path, MaintainPaths=True)  # disabled
item_3 = ListItem(List=branch, Index=Slider(0, range=0..11), Wrap=True)  # disabled
join = JoinCurves(Curves=branch, Preserve=False)  # disabled
end_3 = EndPoints(Curve=join)  # -> Start, End; disabled
ccx = CurveCurve(CurveA=join, CurveB=join)  # -> Points, ParamsA, ParamsB

# ==== cluster AnyTrue: Returns true for a list if any value in the list is true
list_of_bools = ClusterInput()
ma = MassAddition(Input=list_of_bools)  # -> Result, PartialResults
equals = Equality(FirstNumber=ma.Result, SecondNumber=Slider(0, range=0..100))  # -> Equality, Inequality
result = ClusterOutput(equals.Inequality)

# ==== cluster AnyTrue_2: Returns True if any input value is True
values = ClusterInput()
ma = MassAddition(Input=values)  # -> Result, PartialResults
larger = LargerThan(FirstNumber=ma.Result, SecondNumber=Slider(1, range=0..1))  # -> LargerThan, simplify(OrEqualTo)
any_true = ClusterOutput(larger.OrEqualTo)
