# Grasshopper definition 06_07_Distance fields.gh (Grasshopper 1.0.7)
# plug-ins: onScreen

# ----
# Variable
cell_size = Slider(0.2, range=0..10)
threshold = Slider(0.25, range=0..10)
cell_size_2 = Data(cell_size)
threshold_2 = Data(threshold)

# ----
# Control geometry
crv = Curve([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])
area = Area(Geometry=crv)  # -> Area, Centroid
sort = SortList(Keys=area.Area)  # -> Keys, ValuesA

# ----
# Geometry input wall line output
crv_2 = Curve([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])
Z = UnitZ(Factor=1)
Z_2 = UnitZ(Factor=1)  # -> expr("x*1", UnitVector)
extr = Extrude(Base=crv_2, Direction=Z)
move = Move(Geometry=extr, Motion=Z_2)  # -> Geometry, Transform
pt = Point(Point(0, 0, 1))
contour = Contour(Shape=move.Geometry, Point=pt, Direction=Vector(0, 0, 1), Distance=100)
wall_lines = Data(contour)

# ----
# Extreme points
wall_lines_2 = Data(wall_lines)
join = JoinCurves(Curves=flatten(wall_lines_2), Preserve=False)
bbox = BoundingBox(Content=join, Plane=PlaneXY(0, 0, 0), UnionBox=True)  # -> Box, Box_2
debox = DeconstructBox(Box=bbox.Box)  # -> Plane, X, Y, Z
dedomain = DeconstructDomain(Domain=debox.X)  # -> Start, End
dedomain_2 = DeconstructDomain(Domain=debox.Y)  # -> Start, End
dedomain_3 = DeconstructDomain(Domain=debox.Z)  # -> Start, End
min_y = Number(dedomain_2.Start)
max_y = Number(dedomain_2.End)
min_z = Number(dedomain_3.Start)
max_z = Number(dedomain_3.End)
min_x = Number(dedomain.Start)
max_x = Number(dedomain.End)

# ----
# Point Grid
cell_size_3 = Data(cell_size_2)
min_x_2 = Number(min_x)
min_y_2 = Number(min_y)
max_x_2 = Number(max_x)
max_y_2 = Number(max_y)
max_z_2 = Number(max_z)
min_z_2 = Number(min_z)
subtraction = Subtraction(A=max_x_2, B=min_x_2)
subtraction_2 = Subtraction(A=max_y_2, B=min_y_2)
subtraction_3 = Subtraction(A=max_z_2, B=min_z_2)
vec = VectorXYZ(XComponent=cell_size_3, YComponent=cell_size_3, ZComponent=cell_size_3)  # -> Vector, Length
pt_2 = ConstructPoint(XCoordinate=min_x_2, YCoordinate=min_y_2, ZCoordinate=min_z_2)
division = Division(A=subtraction, B=cell_size_3)
division_2 = Division(A=subtraction_2, B=cell_size_3)
division_3 = Division(A=subtraction_3, B=cell_size_3)
move_2 = Move(Geometry=pt_2, Motion=vec.Vector)  # -> Geometry, Transform
round = Round(Number=division)  # -> Nearest, Floor, Ceiling
round_2 = Round(Number=division_2)  # -> Nearest, Floor, Ceiling
round_3 = Round(Number=division_3)  # -> Nearest, Floor, Ceiling
box = Box2Pt(PointA=pt_2, PointB=move_2.Geometry, Plane=PlaneXY(0, 0, 0))
addition = Addition(A=round.Ceiling, B=1)
addition_2 = Addition(A=round_3.Ceiling, B=1)
addition_3 = Addition(A=round_2.Ceiling, B=1)
arrbox = BoxArray(Geometry=pt_2, Cell=box, XCount=addition, YCount=addition_3, ZCount=addition_2)  # -> Geometry, Transform
ray_grid = Data(arrbox.Geometry)

# ----
# Frasorterer punkter for tæt på vægge
# Offset grid method arkiv
number_slider = Slider(1.8, range=0..10)
wall_lines_3 = Line(wall_lines)
point_grid = Point(ray_grid)
threshold_3 = Data(threshold_2)
multiplication = Multiplication(A=threshold_3, B=number_slider)
crv_cp = CurveClosestPoint(Point=point_grid, Curve=graft(wall_lines_3))  # -> Point, Parameter, Distance
flip = FlipMatrix(Data=crv_cp.Distance)
sort_2 = SortList(Keys=flip)  # -> Keys, ValuesA
item = ListItem(List=sort_2.Keys, Index=0, Wrap=True)  # -> flatten(Item)
smaller = SmallerThan(FirstNumber=item, SecondNumber=multiplication)  # -> SmallerThan, OrEqualTo
not = GateNot(A=smaller.SmallerThan)
larger = LargerThan(FirstNumber=item, SecondNumber=threshold_3)  # -> LargerThan, OrEqualTo
not_2 = GateNot(A=larger.LargerThan)
or = GateOr(A=not_2, B=not)
not_3 = GateNot(A=or)
cull_pattern_inner_and_outer = Boolean(not_3)
cull = CullPattern(List=point_grid, CullPattern=cull_pattern_inner_and_outer)
point_grid_2 = Point(cull)

# ----
# Offset grid method
cull_pattern_inner = Boolean(larger.LargerThan)

# ----
# Grouping points and proximity
cell_size_4 = Data(cell_size_2)
point_grid_3 = Point(point_grid_2)
clean = CleanTree(RemoveNulls=True, RemoveInvalid=True, RemoveEmpty=True, Tree=point_grid_3)  # -> flatten(Tree)
expression = Expression(a=cell_size_4, Expression="sqrt(a^2+a^2)+0.01")
pgroups = PointGroups(Points=clean, Distance=expression)  # -> simplify(Groups), Indices
prox = Proximity2D(Points=pgroups.Groups, Plane=PlaneXY(0, 0, 0), Group=8, MaxRadius=expression)  # -> Links, Topology
grouped_points = Point(pgroups.Groups)
topology = Data(prox.Topology)
edges = Data(prox.Links)

# ----
# Remove points with 8 edges
number_of_edges = Slider(8, range=0..10)
topology_2 = Data(topology)  # disabled
lng = ListLength(List=topology_2)
equals = Equality(FirstNumber=lng, SecondNumber=number_of_edges)  # -> Equality, Inequality
edges_2 = Data(edges)
cull_2 = CullPattern(List=edges_2, CullPattern=equals.Inequality)

# ----
# Remove points with edges longer than cell size +0.01
cell_size_5 = Data(cell_size_2)
expression_2 = Expression(a=cell_size_5, Expression="a+0.01")
len = Length(Curve=cull_2)
smaller_2 = SmallerThan(FirstNumber=len, SecondNumber=expression_2)  # -> SmallerThan, OrEqualTo
cull_3 = CullPattern(List=cull_2, CullPattern=smaller_2.SmallerThan)
boundary = BoundarySurfaces(Edges=flatten(cull_3))
room_surface = Data(boundary)

# ----
# Offset room boundary
cell_size_6 = Data(cell_size_2)
threshold_4 = Data(threshold_2)
cell_size_7 = Data(cell_size_2)
threshold_5 = Data(threshold_2)
room_surface_2 = Data(room_surface)
expression_3 = Expression(a=cell_size_6, b=threshold_4, Expression="-(a+(b/2))")
expression_4 = Expression(a=cell_size_7, b=threshold_5, Expression="a+(b/2)")
explode = Explode(Curve=room_surface_2, Recursive=False)  # -> Segments, Vertices
offset = OffsetCurve(Curve=explode.Segments, Distance=expression_3, Plane=PlaneXY(0, 0, 0), Corners=1)
offset_2 = OffsetCurve(Curve=explode.Segments, Distance=expression_4, Plane=PlaneXY(0, 0, 0), Corners=1)
area_2 = Area(Geometry=offset_2)  # -> Area, Centroid
area_3 = Area(Geometry=offset)  # -> Area, Centroid
smaller_3 = SmallerThan(FirstNumber=area_2.Area, SecondNumber=area_3.Area)  # -> SmallerThan, OrEqualTo
p_n_c = PickNChoose(Pattern=smaller_3.SmallerThan, Stream0=offset_2, Stream1=offset)
boundary_2 = BoundarySurfaces(Edges=p_n_c)
mesh = MeshBrep(
    Brep=boundary_2,
    Settings={GridMaxCount=0, GridMinCount=16, JaggedSeams=False, MaxEdgeLength=0, MinEdgeLength=0.0001, MinTolerance=0, Refine=True, RefineAngle=0, RelativeTolerance=0.65, SimplePlanes=True, Tolerance=0})  # -> flatten(Mesh)
room_mesh = Data(mesh)

# ----
# Control
room_mesh_2 = Data(room_mesh)
panel = Panel("""0
3
4
5
6""")
item_2 = ListItem(List=room_mesh_2, Index=panel, Wrap=True)
area_4 = Area(Geometry=item_2)  # -> Area, Centroid
sort_3 = SortList(Keys=area_4.Area)  # -> Keys, ValuesA
subtraction_4 = Subtraction(A=sort_3.Keys, B=sort.Keys)
abs = Absolute(Value=subtraction_4)
number_slider_2 = Slider(100, range=0..100)
division_4 = Division(A=abs, B=sort.Keys)
multiplication_2 = Multiplication(A=division_4, B=number_slider_2)
ma = MassAddition(Input=multiplication_2)  # -> Result, PartialResults
panel_2 = Panel(ma.Result)

# ----
# Control geometry
crv_3 = Curve([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])
area_5 = Area(Geometry=crv_3)  # -> Area, Centroid
sort_4 = SortList(Keys=area_5.Area)  # -> Keys, ValuesA

# ----
# Mesh from edges
edges_3 = Data(edges)
join_2 = JoinCurves(Curves=flatten(edges_3), Preserve=False)
boundary_3 = BoundarySurfaces(Edges=flatten(join_2))
room_surface_3 = Data(boundary_3)
brep = Brep(room_surface_3)
area_6 = Area(Geometry=brep)  # -> Area, Centroid
nullrep = ReplaceNulls(Items=area_6.Area, Replacements=Toggle(False))  # -> Items, Count
larger_2 = LargerThan(FirstNumber=nullrep.Items, SecondNumber=Slider(0.5, range=0..1))  # -> LargerThan, OrEqualTo
cull_4 = CullPattern(List=room_surface_3, CullPattern=larger_2.LargerThan)

# ----
# Offset room boundary
cell_size_8 = Data(cell_size_2)
threshold_6 = Data(threshold_2)
cell_size_9 = Data(cell_size_2)
threshold_7 = Data(threshold_2)
room_surface_4 = Data(cull_4)
expression_5 = Expression(a=cell_size_8, b=threshold_6, Expression="-(a+(b/2))")
expression_6 = Expression(a=cell_size_9, b=threshold_7, Expression="a+(b/2)")
explode_2 = Explode(Curve=room_surface_4, Recursive=False)  # -> Segments, Vertices
offset_3 = OffsetCurve(Curve=explode_2.Segments, Distance=expression_5, Plane=PlaneXY(0, 0, 0), Corners=1)
offset_4 = OffsetCurve(Curve=explode_2.Segments, Distance=expression_6, Plane=PlaneXY(0, 0, 0), Corners=1)
area_7 = Area(Geometry=offset_4)  # -> Area, Centroid
area_8 = Area(Geometry=offset_3)  # -> Area, Centroid
smaller_4 = SmallerThan(FirstNumber=area_7.Area, SecondNumber=area_8.Area)  # -> SmallerThan, OrEqualTo
p_n_c_2 = PickNChoose(Pattern=smaller_4.SmallerThan, Stream0=offset_4, Stream1=offset_3)
boundary_4 = BoundarySurfaces(Edges=p_n_c_2)
mesh_2 = MeshBrep(
    Brep=boundary_4,
    Settings={GridMaxCount=0, GridMinCount=16, JaggedSeams=False, MaxEdgeLength=0, MinEdgeLength=0.0001, MinTolerance=0, Refine=True, RefineAngle=0, RelativeTolerance=0.65, SimplePlanes=True, Tolerance=0})  # -> flatten(Mesh)
room_mesh_3 = Data(mesh_2)

# ----
# Control
room_mesh_4 = Data(room_mesh_3)
area_9 = Area(Geometry=room_mesh_4)  # -> Area, Centroid
sort_5 = SortList(Keys=area_9.Area)  # -> Keys, ValuesA

# ----
# Control geometry
# Distance fields offset to the best possible solution
crv_4 = Curve([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])
area_10 = Area(Geometry=crv_4)  # -> Area, Centroid
sort_6 = SortList(Keys=area_10.Area)  # -> Keys, ValuesA

# ----
# Grouping points and proximity
cull_pattern_inner_2 = Boolean(cull_pattern_inner)
cell_size_10 = Data(cell_size_2)
point_grid_4 = Point(point_grid)
expression_7 = Expression(a=cell_size_10, Expression="sqrt(a^2+a^2)+0.01")
cull_5 = CullPattern(List=point_grid_4, CullPattern=cull_pattern_inner_2)
clean_2 = CleanTree(RemoveNulls=True, RemoveInvalid=True, RemoveEmpty=True, Tree=cull_5)  # -> flatten(Tree)
pgroups_2 = PointGroups(Points=clean_2, Distance=expression_7)  # -> simplify(Groups), Indices
# Cull pattern: Any ray distance below threshold
# Cull pattern: Any ray in list has not hit an object
grouped_points_2 = Point(pgroups_2.Groups)

# ----
# Distance fields to point cloud
grouped_points_3 = Point(grouped_points_2)

# ----
# Alpha
cell_size_11 = Data(cell_size_2)
expression_8 = Expression(a=cell_size_11, Expression="sqrt(a^2+a^2)")
alpha = AlphaShape(Points=grouped_points_3, Radius=expression_8, Plane=PlaneXY(0, 0, 0))
cell_size_12 = Data(cell_size_2)
expression_9 = Expression(a=cell_size_12, Expression="sqrt(a^2+(2*a)^2)")
explode_3 = Explode(Curve=alpha, Recursive=True)  # -> flatten(Segments), Vertices
len_2 = Length(Curve=explode_3.Segments)
smaller_5 = SmallerThan(FirstNumber=len_2, SecondNumber=expression_9)  # -> SmallerThan, OrEqualTo
cull_6 = CullPattern(List=explode_3.Segments, CullPattern=smaller_5.OrEqualTo)
boundary_5 = BoundarySurfaces(Edges=flatten(cull_6))
room_surface_5 = Data(boundary_5)

# ----
# Offset room boundary
cell_size_13 = Data(cell_size_2)
threshold_8 = Data(threshold_2)
threshold_9 = Data(threshold_2)
cell_size_14 = Data(cell_size_2)
room_surface_6 = Data(room_surface_5)
expression_10 = Expression(a=cell_size_13, b=threshold_8, Expression="-(a+(b/2))")
expression_11 = Expression(a=cell_size_14, b=threshold_9, Expression="a+(b/2)")
explode_4 = Explode(Curve=room_surface_6, Recursive=False)  # -> Segments, Vertices
offset_5 = OffsetCurve(Curve=explode_4.Segments, Distance=expression_10, Plane=PlaneXY(0, 0, 0), Corners=1)
offset_6 = OffsetCurve(Curve=explode_4.Segments, Distance=expression_11, Plane=PlaneXY(0, 0, 0), Corners=1)
area_11 = Area(Geometry=offset_6)  # -> Area, Centroid
area_12 = Area(Geometry=offset_5)  # -> Area, Centroid
smaller_6 = SmallerThan(FirstNumber=area_11.Area, SecondNumber=area_12.Area)  # -> SmallerThan, OrEqualTo
p_n_c_3 = PickNChoose(Pattern=smaller_6.SmallerThan, Stream0=offset_6, Stream1=offset_5)
boundary_6 = BoundarySurfaces(Edges=p_n_c_3)
mesh_3 = MeshBrep(
    Brep=boundary_6,
    Settings={GridMaxCount=0, GridMinCount=16, JaggedSeams=False, MaxEdgeLength=0, MinEdgeLength=0.0001, MinTolerance=0, Refine=True, RefineAngle=0, RelativeTolerance=0.65, SimplePlanes=True, Tolerance=0})  # -> flatten(Mesh)
room_mesh_5 = Data(mesh_3)

# ----
# Control
room_mesh_6 = Data(room_mesh_5)
panel_3 = Panel("""1
2
3
4
5""")
item_3 = ListItem(List=room_mesh_6, Index=panel_3, Wrap=True)
area_13 = Area(Geometry=item_3)  # -> Area, Centroid
sort_7 = SortList(Keys=area_13.Area)  # -> Keys, ValuesA

# ----
# Totalafvigelse i procent
ma_2 = MassAddition(Input=sort_5.Keys)  # -> Result, PartialResults
ma_3 = MassAddition(Input=sort_4.Keys)  # -> Result, PartialResults
subtraction_5 = Subtraction(A=ma_2.Result, B=ma_3.Result)
abs_2 = Absolute(Value=subtraction_5)
number_slider_3 = Slider(100, range=0..100)
division_5 = Division(A=abs_2, B=ma_3.Result)
multiplication_3 = Multiplication(A=division_5, B=number_slider_3)
panel_4 = Panel(multiplication_3)

# ----
# Totalafvigelse i procent
ma_4 = MassAddition(Input=sort_7.Keys)  # -> Result, PartialResults
ma_5 = MassAddition(Input=sort_6.Keys)  # -> Result, PartialResults
subtraction_6 = Subtraction(A=ma_4.Result, B=ma_5.Result)
abs_3 = Absolute(Value=subtraction_6)
number_slider_4 = Slider(100, range=0..100)
division_6 = Division(A=abs_3, B=ma_5.Result)
multiplication_4 = Multiplication(A=division_6, B=number_slider_4)
panel_5 = Panel(multiplication_4)

# ----
# Afvigelse pr. rum
subtraction_7 = Subtraction(A=sort_5.Keys, B=sort_4.Keys)
abs_4 = Absolute(Value=subtraction_7)
number_slider_5 = Slider(100, range=0..100)
division_7 = Division(A=abs_4, B=sort_4.Keys)
multiplication_5 = Multiplication(A=division_7, B=number_slider_5)
panel_6 = Panel(multiplication_5)

# ----
# Afvigelse pr. rum
subtraction_8 = Subtraction(A=sort_7.Keys, B=sort_6.Keys)
abs_5 = Absolute(Value=subtraction_8)
number_slider_6 = Slider(100, range=0..100)
division_8 = Division(A=abs_5, B=sort_6.Keys)
multiplication_6 = Multiplication(A=division_8, B=number_slider_6)
panel_7 = Panel(multiplication_6)

subtraction_9 = Subtraction(A=ma_4.Result, B=ma_5.Result)
