# Grasshopper definition Distance_Fields.gh (Grasshopper 1.0.7)

# ----
# Test geometry
surfaces_to_test = Brep([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])
std_test_room = Curve([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])
curved_rooms = Curve([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])
mesh_to_test = Mesh([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])

brep = Brep(surfaces_to_test)

# ----
# Geometry input to floor plan
explode = Explode(Curve=curved_rooms, Recursive=True)  # -> flatten(Segments), Vertices
Z = UnitZ(Factor=2.5)
extr = Extrude(Base=explode.Segments, Direction=Z)
Z_2 = UnitZ(Factor=0.5)
pt = Point(Point(0, 0, 1))
move = Move(Geometry=extr, Motion=Z_2)  # -> Geometry, Transform
# Distance field + Point cloud
contour = Contour(Shape=move.Geometry, Point=pt, Direction=Vector(0, 0, 1), Distance=100)
project = Project(Geometry=contour, Plane=PlaneXY(0, 0, 0))  # -> Geometry, Transform
floor_plan = Data(project.Geometry)

# ----
# Variables
cell_size = Slider(0.3, range=0..10)
threshold = Slider(0.25, range=0..10)
threshold_2 = Data(threshold)
cell_size_2 = Data(cell_size)

# ----
# Extreme points
floor_plan_2 = Curve(floor_plan)
explode_2 = Explode(Curve=floor_plan_2, Recursive=True)  # -> Segments, flatten(Vertices)
bnd = Bounds2D(Coordinates=explode_2.Vertices)
dedom2 = DeconstructDomain²(Domain=bnd)  # -> UComponent, VComponent
dedomain = DeconstructDomain(Domain=dedom2.VComponent)  # -> Start, End
dedomain_2 = DeconstructDomain(Domain=dedom2.UComponent)  # -> Start, End
min_y = Number(dedomain.Start)
min_x = Number(dedomain_2.Start)
max_x = Number(dedomain_2.End)
max_y = Number(dedomain.End)

# ----
# Point Grid
min_y_2 = Number(min_y)
min_x_2 = Number(min_x)
max_x_2 = Number(max_x)
max_y_2 = Number(max_y)
cell_size_3 = Number(cell_size_2)
pt_2 = ConstructPoint(XCoordinate=min_x_2, YCoordinate=min_y_2, ZCoordinate=0)
vec = VectorXYZ(XComponent=cell_size_3, YComponent=cell_size_3, ZComponent=0)  # -> Vector, Length
rev = Reverse(Vector=vec.Vector)
subtraction = Subtraction(A=max_y_2, B=min_y_2)
subtraction_2 = Subtraction(A=max_x_2, B=min_x_2)
move_2 = Move(Geometry=pt_2, Motion=rev)  # -> Geometry, Transform
division = Division(A=subtraction, B=cell_size_3)
division_2 = Division(A=subtraction_2, B=cell_size_3)
round = Round(Number=division)  # -> Nearest, Floor, Ceiling
round_2 = Round(Number=division_2)  # -> Nearest, Floor, Ceiling
addition = Addition(A=round_2.Ceiling, B="2")
addition_2 = Addition(A=round.Ceiling, B="2")
sqgrid = Square(Plane=move_2.Geometry, Size=cell_size_3, ExtentX=addition, ExtentY=addition_2)  # -> Cells, Points
num = Number(addition)
num_2 = Number(addition_2)
point_grid = Point(flatten(sqgrid.Points))
item = TreeItem(Tree=simplify(sqgrid.Points), Path=graft(["0", num]), Index=["0", num_2], Wrap=True)
corners = Point(flatten(item))

# ----
# Cull points closer than threshold to walls
point_grid_2 = Point(point_grid)
floor_plan_3 = Curve(floor_plan)
pull = PullPoint(Point=point_grid_2, Geometry=simplify(floor_plan_3), ClosestOnly=True)  # -> ClosestPoint, Distance
flip = FlipMatrix(Data=pull.Distance)
sort = SortList(Keys=flip)  # -> Keys, ValuesA
item_2 = ListItem(List=sort.Keys, Index=0, Wrap=True)  # -> flatten(Item)
threshold_3 = Data(threshold_2)
larger = LargerThan(FirstNumber=item_2, SecondNumber=threshold_3)  # -> LargerThan, OrEqualTo
cull = CullPattern(List=point_grid_2, CullPattern=larger.LargerThan)
modified_point_grid = Point(cull)

floor_plan_4 = Data(floor_plan)

# ----
# Find Closest points that are not endpoints and are within the distance limit
floor_plan_5 = Curve(floor_plan_4)
crv = Curve(flatten(floor_plan_5))
end = EndPoints(Curve=crv)  # -> Start, End
crv_cp = CurveClosestPoint(Point=simplify(graft([end.Start, end.End])), Curve=reparameterize(crv))  # -> Point, Parameter, Distance
smaller = SmallerThan(FirstNumber=crv_cp.Distance, SecondNumber=Slider(0.5, range=0..1))  # -> SmallerThan, OrEqualTo
larger_2 = LargerThan(FirstNumber=crv_cp.Parameter, SecondNumber="1-1e-3")  # -> LargerThan, OrEqualTo
smaller_2 = SmallerThan(FirstNumber=crv_cp.Parameter, SecondNumber="1e-3")  # -> SmallerThan, OrEqualTo
or = GateOr(A=larger_2.LargerThan, B=smaller_2.SmallerThan)
not = GateNot(A=or)
and = GateAnd(A=not, B=smaller.SmallerThan)  # -> simplify(Result)
parameters = Number(simplify(crv_cp.Parameter))
path_mapper = PathMapper(and, source="{A}(B)", target="{B}(A)")
path_mapper_2 = PathMapper(parameters, source="{A}(B)", target="{B}(A)")
cull_2 = CullPattern(List=simplify(path_mapper_2), CullPattern=simplify(path_mapper))
any = AnyTrue(values=path_mapper)  # -> flatten(any_true)
not_2 = GateNot(A=any)
shatter = Shatter(Curve=graft(crv), Parameters=cull_2)
cull_3 = CullPattern(List=simplify(crv), CullPattern=not_2)
shattered_curves = Curve(shatter)
curves_to_keep = Curve(cull_3)
merge = Merge(Data1=flatten(shattered_curves), Data2=flatten(curves_to_keep))
shatted_floor_plans = Curve(merge)

# ----
# Grouping points and proximity
cell_size_4 = Data(cell_size_2)
modified_point_grid_2 = Point(modified_point_grid)
expression = Expression(a=cell_size_4, Expression="sqrt(a^2+a^2)+0.01")
pgroups = PointGroups(Points=modified_point_grid_2, Distance=expression)  # -> simplify(Groups), Indices
grouped_points = Point(pgroups.Groups)

# ----
# Remove groups of points containing corners
corner_points = Point(flatten(corners))
grouped_points_2 = Point(grouped_points)
lng = ListLength(List=grouped_points_2)
intersection = SetIntersection(SetA=corner_points, SetB=grouped_points_2)
lng_2 = ListLength(List=intersection)
larger_3 = LargerThan(FirstNumber=lng, SecondNumber=Slider(30, range=0..100))  # -> LargerThan, OrEqualTo
equals = Equality(FirstNumber=lng_2, SecondNumber=Slider(0, range=0..100))  # -> Equality, Inequality
and_2 = GateAnd(A=equals.Equality, B=larger_3.LargerThan)
cull_4 = CullPattern(List=grouped_points_2, CullPattern=and_2)
clean = CleanTree(RemoveNulls=True, RemoveInvalid=True, RemoveEmpty=True, Tree=cull_4)
grouped_points_3 = Point(clean)

# ----
# Concave curve
number_slider = Slider(0.5, range=0..1)
roomed_points = Point(grouped_points_3)
concavehull = PythonScript(pts=roomed_points, factor=number_slider)  # -> out, concaveHull; inputs pts: list of Point3d
# ---------- concavehull: Python ----------
import ghpythonlib.components as ghComp
import rhinoscriptsyntax as rs

# make mesh and get faces
mesh = ghComp.DelaunayMesh(pts)
vertices,faces,colours,normals = ghComp.DeconstructMesh(mesh)

# get max distance of edges of all faces
maxDists=[]
for face in faces:
    dist1=rs.Distance(pts[face.A],pts[face.B])
    dist2=rs.Distance(pts[face.B],pts[face.C])
    dist3=rs.Distance(pts[face.C],pts[face.A])
    maxDist=max(dist1,dist2,dist3)
    maxDists.append(maxDist)

# get median 
sortedDists = sorted(maxDists)
medIndex = int(len(sortedDists)/2)
median = sortedDists[medIndex]

# keep faces with edges within treshold
distTreshold=median*(1.0+factor)
newMesh=[]
i = 0
for face in faces:
    if(maxDists[i]<distTreshold):
        newMesh.append(face)
    i+=1

# create final meshes and outlines
finalMesh=ghComp.ConstructMesh(vertices,newMesh)
concaveHull = rs.MeshOutline(finalMesh)
# ---------- end concavehull ----------
concave_curves = Curve(concavehull.concaveHull)

# ----
# Pull concave verticies to nearest floor plan geometry
room_boundaries = Curve(concave_curves)
floor_plan_6 = Curve(floor_plan_4)
simplify = SimplifyCurve(Curve=room_boundaries)  # -> Curve, Simplified
explode_3 = Explode(Curve=simplify.Curve, Recursive=True)  # -> Segments, Vertices
pull_2 = PullPoint(Point=explode_3.Vertices, Geometry=flatten(floor_plan_6), ClosestOnly=True)  # -> ClosestPoint, Distance
closest_points = Point(pull_2.ClosestPoint)

# ----
# Cull points with an angle larger than 170 degrees
closest_points_2 = Point(closest_points)
cullpt = CullDuplicates(Points=closest_points_2, Tolerance=0.1, CullMode=3)  # -> Points, Indices, Valence
shift = ShiftList(List=cullpt.Points, Shift=-1, Wrap=True)
shift_2 = ShiftList(List=cullpt.Points, Shift=1, Wrap=True)
vec2pt = Vector2Pt(PointA=cullpt.Points, PointB=shift_2, Unitize=False)  # -> Vector, Length
vec2pt_2 = Vector2Pt(PointA=cullpt.Points, PointB=shift, Unitize=False)  # -> Vector, Length
angle = Angle(VectorA=vec2pt.Vector, VectorB=vec2pt_2.Vector)  # -> Angle, Reflex
deg = Degrees(Radians=angle.Angle)
smaller_3 = SmallerThan(FirstNumber=deg, SecondNumber=Slider(169, range=0..1000))  # -> SmallerThan, OrEqualTo
cull_5 = CullPattern(List=cullpt.Points, CullPattern=smaller_3.SmallerThan)
points_pulled_onto_floor_plan = Point(cullpt.Points)
corner_points_to_replace = Point(cull_5)

# ----
# Replace closest "corner" points with end points
shatted_wall_lines = Curve(shatted_floor_plans)
points_pulled_onto_floor_plan_2 = Point(points_pulled_onto_floor_plan)
corner_points_to_replace_2 = Point(corner_points_to_replace)
end_2 = EndPoints(Curve=shatted_wall_lines)  # -> Start, End
cp = ClosestPoint(Point=corner_points_to_replace_2, Cloud=[end_2.Start, end_2.End])  # -> ClosestPoint, CPIndex, Distance
replace = ReplaceMembers(Set=points_pulled_onto_floor_plan_2, Find=corner_points_to_replace_2, Replace=cp.ClosestPoint)
sorted_culled_points = Point(replace)

# ----
# Control geometry
crv_2 = Curve([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])  # disabled
area = Area(Geometry=crv_2)  # -> Area, Centroid; disabled
sort_2 = SortList(Keys=area.Area)  # -> Keys, ValuesA; disabled

# ----
# Create Surface
sorted_culled_points_2 = Point(sorted_culled_points)
pline = PolyLine(Vertices=sorted_culled_points_2, Closed=True)
boundary = BoundarySurfaces(Edges=pline)
room_surfaces = Data(boundary)

# ----
# Control
room_mesh = Data(room_surfaces)  # disabled
area_2 = Area(Geometry=flatten(room_mesh))  # -> Area, Centroid; disabled
sort_3 = SortList(Keys=area_2.Area)  # -> Keys, ValuesA; disabled

# ----
# Totalafvigelse i procent
ma = MassAddition(Input=sort_3.Keys)  # -> Result, PartialResults; disabled
ma_2 = MassAddition(Input=sort_2.Keys)  # -> Result, PartialResults; disabled
subtraction_3 = Subtraction(A=ma.Result, B=ma_2.Result)  # disabled
abs = Absolute(Value=subtraction_3)  # disabled
number_slider_2 = Slider(100, range=0..100)  # disabled
division_3 = Division(A=abs, B=ma_2.Result)  # disabled
multiplication = Multiplication(A=division_3, B=number_slider_2)  # disabled
# Afvigelse pr. rum
# Totalafvigelse i procent
# Afvigelse pr. rum
# Offset curves w. average distance to closest wall line
# Totalafvigelse i procent
panel = Panel(multiplication)  # disabled

# ----
# Afvigelse pr. rum
subtraction_4 = Subtraction(A=sort_3.Keys, B=sort_2.Keys)  # disabled
abs_2 = Absolute(Value=subtraction_4)  # disabled
number_slider_3 = Slider(100, range=0..100)  # disabled
division_4 = Division(A=abs_2, B=sort_2.Keys)  # disabled
multiplication_2 = Multiplication(A=division_4, B=number_slider_3)  # disabled
# Cull pattern: Any ray distance below threshold
# Cull pattern: Any ray in list has not hit an object
panel_2 = Panel(multiplication_2)  # disabled

# ==== cluster AnyTrue: Returns True if any input value is True
values = ClusterInput()
ma = MassAddition(Input=values)  # -> Result, PartialResults
larger = LargerThan(FirstNumber=ma.Result, SecondNumber=Slider(1, range=0..1))  # -> LargerThan, simplify(OrEqualTo)
any_true = ClusterOutput(larger.OrEqualTo)
