# Grasshopper definition balloon+regions.gh (Grasshopper 1.0.7)
# plug-ins: Weaverbird, Kangaroo2 Components

# ----
# Merge balloon meshes
# (TOGGLE AFTER INFLATION)
merge_balloon_meshes = BooleanToggle(False)

# ----
# Reset/run balloon simulation
button = Button()

# ----
# Enable balloon simulation
toggle = BooleanToggle(False)

# ----
# Variable
cell_size = Slider(23, range=0..50)
threshold = Slider(10, range=0..10)
threshold_2 = Data(threshold)
cell_size_2 = Data(cell_size)

# ---- group: Building mesh
mesh = Mesh([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])

# ----
# Extreme XY points
wbjoin = WeaverbirdsJoinMeshesAndWeld(Mesh=mesh, Weld=False)
bbox = BoundingBox(Content=wbjoin, Plane=PlaneXY(0, 0, 0))  # -> Box, Box_2
debox = DeconstructBox(Box=bbox.Box)  # -> Plane, X, Y, Z
dedomain = DeconstructDomain(Domain=debox.X)  # -> Start, End
dedomain_2 = DeconstructDomain(Domain=debox.Y)  # -> Start, End
min_x = Number(dedomain.Start)
max_x = Number(dedomain.End)
min_y = Number(dedomain_2.Start)
max_y = Number(dedomain_2.End)

# ----
# Point Grid
max_x_2 = Number(max_x)
max_y_2 = Number(max_y)
cell_size_3 = Number(cell_size_2)
min_y_2 = Number(min_y)
min_x_2 = Number(min_x)
pt = ConstructPoint(XCoordinate=min_x_2, YCoordinate=min_y_2, ZCoordinate=0)
subtraction = Subtraction(A=max_x_2, B=min_x_2)
subtraction_2 = Subtraction(A=max_y_2, B=min_y_2)
division = Division(A=subtraction, B=cell_size_3)
division_2 = Division(A=subtraction_2, B=cell_size_3)
sqgrid = Square(Plane=pt, Size=cell_size_3, ExtentX=division, ExtentY=division_2)  # -> Cells, Points
point_grid = Point(flatten(sqgrid.Points))

# ----
# Cull points closer than threshold to walls
point_grid_2 = Point(point_grid)
pull = PullPoint(Point=point_grid_2, Geometry=simplify(mesh), ClosestOnly=True)  # -> ClosestPoint, Distance
flip = FlipMatrix(Data=pull.Distance)
sort = SortList(Keys=flip)  # -> Keys, ValuesA
item = ListItem(List=sort.Keys, Index=0, Wrap=True)  # -> flatten(Item)
threshold_3 = Data(threshold_2)
larger = LargerThan(FirstNumber=item, SecondNumber=threshold_3)  # -> LargerThan, OrEqualTo
cull = CullPattern(List=point_grid_2, CullPattern=larger.LargerThan)
modified_point_grid = Point(cull)

# ----
# Initializes balloons
wbicosahedron = WeaverbirdsMeshMeshIcosahedron(Plane=modified_point_grid, Radius=expr("x*0.9", threshold_2))
wbloop = WeaverbirdsLoopSubdivision(MeshCurves=wbicosahedron, Level=2, SmoothNakedEdges=1)  # -> flatten(OutputMeshCurves)

# ----
# Balloons/balloons collisions
crossref = CrossReference(ListA=flatten(wbloop), ListB=flatten(wbloop), CrossMode=5)  # -> ListA, ListB
demesh = DeconstructMesh(Mesh=crossref.ListB)  # -> Vertices, Faces, Colours, Normals
spc = SolidPointCollide(Points=demesh.Vertices, Solid=graft(crossref.ListA), Interior=False, Unidirectional=False, Strength=120)

# ----
# Balloon 'compression'
number_slider = Slider(9, range=1..15)
edgelengths = EdgeLengths(Mesh=wbloop, LengthFactor=Slider(2, range=0..4), Strength=number_slider)

# ----
# Balloons inflation pressure
number_slider_2 = Slider(1.1, range=0..2)
pressure = Pressure(M=wbloop, Strength=number_slider_2)

# ----
# Balloons/mesh collisions
demesh_2 = DeconstructMesh(Mesh=wbloop)  # -> Vertices, Faces, Colours, Normals
spc_2 = SolidPointCollide(Points=demesh_2.Vertices, Solid=wbjoin, Interior=True, Unidirectional=True, Strength=Slider(100, range=1..1000))

show = Show(G=wbloop)
entwine = Entwine(Branch00=[edgelengths, spc_2, pressure, spc], Branch01=show, FlattenInputs=True)

# ----
# Run balloon simulation
number_slider_3 = Slider(0.0174, range=0.0001..1)
bouncysolver = BouncySolver(GoalObjects=entwine, Reset=button, Threshold=1e-15, Tolerance=0.01, Damping=number_slider_3, Iterations=10, On=toggle)  # -> I, V, O

# ----
# Visualize balloons
mesh_2 = Mesh(bouncysolver.O)

clean_tree = CleanTree(RemoveNulls=True, RemoveInvalid=True, RemoveEmpty=False, Tree=mesh_2)

wbloop_2 = WeaverbirdsLoopSubdivision(MeshCurves=clean_tree, Level=1, SmoothNakedEdges=1)
colourful = Colourful(geo=wbloop_2)

data = Data(wbloop_2)

# ----
# Merges balloon meshes
stream_filter = StreamFilter(Gate=merge_balloon_meshes, Stream0=flatten(data))
mesh_union = MeshUnion(Meshes=flatten(stream_filter))

# ==== cluster Colourful: Display objects in bright colours
geo = ClusterInput()
geo_2 = Geometry(geo)
clean = CleanTree(RemoveNulls=True, RemoveInvalid=True, RemoveEmpty=False, Tree=flatten(geo_2))
S = Shader([{diffuse=RGB(11, 125, 222), emission=RGB(3, 38, 67), shine=0.5, specular=RGB(255, 255, 255), transparency=0}, {diffuse=RGB(222, 37, 11), emission=RGB(67, 11, 3), shine=0.5, specular=RGB(255, 255, 255), transparency=0}, {diffuse=RGB(71, 222, 11), emission=RGB(21, 67, 3), shine=0.5, specular=RGB(255, 255, 255), transparency=0}, {diffuse=RGB(222, 194, 11), emission=RGB(67, 58, 3), shine=0.5, specular=RGB(255, 255, 255), transparency=0}])
lng = ListLength(List=clean)
repeat = RepeatData(Data=S, Length=lng)
preview = CustomPreview(Geometry=clean, Shader=repeat)
