# Grasshopper definition balloon+unordered_points.gh (Grasshopper 1.0.7)
# plug-ins: LunchBox

n = Slider(5, range=0..10)
path = FilePath("C:\Users\sdmei\Desktop\rooms\script.py")
file = ReadFile(File=path, PerLineParse=False)
python = GhPythonScript(Code=file, S="THIS IS A STRING", N=n)  # -> Out, A
a = Panel(python.A)
out = Panel(python.Out)

# ----
# Point Grid Cell Size
cell_size = Slider(1, range=0..10)
# Single point location
md_slider = MDSlider(
    SliderMode=0,
    slider_value=Point(0.8692274791, 0.6148354692, 0.5),
    x_domain=Domain(0, 1),
    y_domain=Domain(0, 1),
    z_domain=Domain(0, 1))
# Number of Rays
number_of_rays = Slider(8, range=0..100)
list = ValueList({"Single Point": 0, "Point Array": 1}, selected="Point Array")
# Building Mesh
mesh = Mesh([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])

# ----
# Plantegning
number_slider = Slider(1, range=0..10)
mesh_2 = Mesh(mesh)
pt = ConstructPoint(XCoordinate=0, YCoordinate=0, ZCoordinate=number_slider)
xy = XYPlane(Origin=pt)
sec = MeshPlane(Mesh=mesh_2, Plane=xy)
xy_2 = XYPlane(Origin=Point(0, 0, 0))
project = Project(Geometry=sec, Plane=xy_2)  # -> Geometry, Transform
clean = CleanTree(RemoveNulls=True, RemoveInvalid=True, RemoveEmpty=True, Tree=project.Geometry)
wall_lines = Line(flatten(clean))

# ----
# Single Point Picker
wall_lines_2 = Line(flatten(wall_lines))
md_picker = Point(md_slider)
end = EndPoints(Curve=wall_lines_2)  # -> Start, End
sort_pt = SortPoints(Points=flatten([end.Start, end.End]))  # -> Points, Indices
item = ListItem(List=sort_pt.Points, Index=0, Wrap=True)  # -> Item1, Item
multiplication = Multiplication(A=md_picker, B=item.Item1)
isovist_point = Point(multiplication)

# ----
# Extreme points
wall_lines_3 = Line(flatten(wall_lines))
bbox = BoundingBox(Content=wall_lines_3, Plane=PlaneXY(0, 0, 0), UnionBox=True)  # -> Box, Box_2
box = EvaluateBox(Box=bbox.Box, UParameter=1, VParameter=1, WParameter=1)  # -> Plane, Point, Include
debox = DeconstructBox(Box=bbox.Box)  # -> Plane, X, Y, Z
dedomain = DeconstructDomain(Domain=debox.X)  # -> Start, End
dedomain_2 = DeconstructDomain(Domain=debox.Y)  # -> Start, End
dedomain_3 = DeconstructDomain(Domain=debox.Z)  # -> Start, End
vlen = VectorLength(Vector=box.Point)
min_x = Number(dedomain.Start)
max_x = Number(dedomain.End)
min_y = Number(dedomain_2.Start)
max_y = Number(dedomain_2.End)
min_z = Number(dedomain_3.Start)
max_z = Number(dedomain_3.End)
longest_distance = Number(vlen)

# ----
# Point Grid
min_y_2 = Number(min_y)
max_x_2 = Number(max_x)
max_z_2 = Number(max_z)
min_x_2 = Number(min_x)
min_z_2 = Number(min_z)
max_y_2 = Number(max_y)
cell_size_2 = Number(cell_size)
subtraction = Subtraction(A=max_x_2, B=min_x_2)
subtraction_2 = Subtraction(A=max_y_2, B=min_y_2)
subtraction_3 = Subtraction(A=max_z_2, B=min_z_2)
vec = VectorXYZ(XComponent=cell_size_2, YComponent=cell_size_2, ZComponent=cell_size_2)  # -> Vector, Length
pt_2 = ConstructPoint(XCoordinate=min_x_2, YCoordinate=min_y_2, ZCoordinate=min_z_2)
move = Move(Geometry=pt_2, Motion=vec.Vector)  # -> Geometry, Transform
division = Division(A=subtraction, B=cell_size_2)
division_2 = Division(A=subtraction_2, B=cell_size_2)
division_3 = Division(A=subtraction_3, B=cell_size_2)
round = Round(Number=division)  # -> Nearest, Floor, Ceiling
round_2 = Round(Number=division_2)  # -> Nearest, Floor, Ceiling
round_3 = Round(Number=division_3)  # -> Nearest, Floor, Ceiling
box_2 = Box2Pt(PointA=pt_2, PointB=move.Geometry, Plane=PlaneXY(0, 0, 0))
addition = Addition(A=round.Ceiling, B=1)
addition_2 = Addition(A=round_2.Ceiling, B=1)
addition_3 = Addition(A=round_3.Ceiling, B=1)
arrbox = BoxArray(Geometry=pt_2, Cell=box_2, XCount=addition, YCount=addition_2, ZCount=addition_3)  # -> Geometry, Transform
point_grid = Point(arrbox.Geometry)

point_choice = Number(list)

# ----
# Ray Fan
number_of_rays_2 = Number(number_of_rays)
single_point = Point(isovist_point)
ray_radius = Number(longest_distance)
point_grid_2 = Point(point_grid)
cluster = Cluster(number_of_vectors=number_of_rays_2)

filter = StreamFilter(Gate=point_choice, Stream0=single_point, Stream1=point_grid_2)  # -> graft(Stream)

line = LineSDL(Start=filter, Direction=cluster, Length=ray_radius)
ray_fan = Line(line)

# ----
# Isovist
wall_lines_4 = Line(flatten(wall_lines))
ray_radius_2 = Number(longest_distance)
ray_fans = Line(ray_fan)
ivray = IsoVistRay(Sample=simplify(ray_fans), Radius=ray_radius_2, Obstacles=wall_lines_4)  # -> Point, Distance, Index
equals = Equality(FirstNumber=ivray.Index, SecondNumber="-1")  # -> Equality, Inequality
any = AnyTrue(list_of_bools=equals.Equality)
item_2 = ListItem(List=wall_lines_4, Index=ivray.Index, Wrap=False)
not = GateNot(A=any)
cull = CullPattern(List=ivray.Index, CullPattern=not)
cull_2 = CullPattern(List=ray_fans, CullPattern=not)
cull_3 = CullPattern(List=item_2, CullPattern=not)
cull_4 = CullPattern(List=ivray.Point, CullPattern=not)
wall_lines_5 = Line(cull_3)
hits = Point(cull_4)
rays = Line(cull_2)

# ----
# Normals
rays_2 = Line(rays)
wall_lines_6 = Line(wall_lines_5)
end_2 = EndPoints(Curve=wall_lines_6)  # -> Start, End
Z = UnitZ(Factor=1)
end_3 = EndPoints(Curve=rays_2)  # -> Start, End
pl = ConstructPlane(Origin=end_2.Start, XAxis=wall_lines_6, YAxis=Z)
cp = PlaneClosestPoint(Point=end_3.Start, Plane=pl)  # -> Point, UVPoint, Distance
xprod = CrossProduct(VectorA=wall_lines_6, VectorB=Z, Unitize=False)  # -> Vector, Length
smaller = SmallerThan(FirstNumber=cp.Distance, SecondNumber="0")  # -> SmallerThan, OrEqualTo
rev = Reverse(Vector=xprod.Vector)
p_n_c = PickNChoose(Pattern=smaller.SmallerThan, Stream0=xprod.Vector, Stream1=rev)
normal = Vector(p_n_c)

panel = Panel(wall_lines_5)
hits_2 = Point(hits)
line_2 = LineSDL(Start=hits_2, Direction=normal, Length=Slider(0.25, range=0..1))
sort_duplicate_curves = SortDuplicateCurves(Curves=wall_lines_5)  # -> UniqueCurves, Indices
wall_lines_7 = Line(sort_duplicate_curves.UniqueCurves)
prune_tree = PruneTree(Tree=wall_lines_7, Minimum=1, Maximum=0)
join_curves = JoinCurves(Curves=prune_tree, Preserve=False)  # -> simplify(Curves)
panel_2 = Panel(join_curves)
closed = Closed(Curve=join_curves)  # -> flatten(Closed), Periodic
tree_branch = TreeBranch(Tree=join_curves, Path=Slider(86, range=0..150), MaintainPaths=True)
cull_pattern = CullPattern(List=flatten(join_curves), CullPattern=closed.Closed)
sort_duplicate_curves_2 = SortDuplicateCurves(Curves=cull_pattern)  # -> UniqueCurves, Indices

# ==== cluster Cluster
number_of_vectors = ClusterInput()
pi = Pi(Factor="2")
vec = VectorXYZ(XComponent="2", YComponent=0, ZComponent=0)  # -> Vector, Length
subtraction = Subtraction(A=number_of_vectors, B=1)
division = Division(A=pi, B=number_of_vectors)
dom = ConstructDomain(DomainStart=division, DomainEnd=pi)
Z = UnitZ(Factor=1)
range = Range(Domain=dom, Steps=subtraction)
vrot = Rotate(Vector=vec.Vector, Axis=Z, Angle=range)
vector_fan = ClusterOutput(vrot)

# ==== cluster AnyTrue: Returns true for a list if any value in the list is true
list_of_bools = ClusterInput()
ma = MassAddition(Input=list_of_bools)  # -> Result, PartialResults
equals = Equality(FirstNumber=ma.Result, SecondNumber=Slider(0, range=0..100))  # -> Equality, Inequality
result = ClusterOutput(equals.Inequality)
