# Grasshopper definition extend_curve_to_curve.gh (Grasshopper 1.0.7)

current_directory = GhPythonScript()  # -> dir
# ---------- current_directory: Python ----------
import Grasshopper
path = Grasshopper.Instances.ActiveCanvas.Document.FilePath
dir = "\\".join(path.split("\\")[:-1])+"\\"
# ---------- end current_directory ----------
distance_threshold = Slider(706, range=0..1000)
concat = Concatenate(FragmentA=current_directory, FragmentB="extend_curve_to_curve.py")
file = ReadFile(File=concat, PerLineParse=False)
crv = Curve([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])
extendcrvtocrv = GhPythonScript(Code=file, C=crv, T=distance_threshold)
crv_2 = Curve(extendcrvtocrv)
