# Grasshopper definition merge_sets_by_intersection.gh (Grasshopper 1.0.7)

current_directory = GhPythonScript()  # -> dir
# ---------- current_directory: Python ----------
import Grasshopper
path = Grasshopper.Instances.ActiveCanvas.Document.FilePath
dir = "\\".join(path.split("\\")[:-1])+"\\"
# ---------- end current_directory ----------
concat = Concatenate(FragmentA=current_directory, FragmentB="merge_sets_by_intersection.py")
file = ReadFile(File=concat, PerLineParse=False)
curves = Line(Tree({0}: [Line((13107.97048, 11000, 0), (13107.97048, 11400, 0)), Line((8707.970485, 19239.94245, 0), (8707.970485, 11800, 0)), Line((6307.970485, 28947.82669, 0), (400, 28947.82669, 0)), Line((400, 28947.82669, 0), (400, 9809.791898, 0)), Line((400, 28947.82669, 0), (400, 9809.791898, 0)), Line((400, 28947.82669, 0), (400, 9809.791898, 0)), Line((400, 9809.791898, 0), (6707.970485, 9809.791898, 0)), Line((400, 9809.791898, 0), (6707.970485, 9809.791898, 0))], {1}: [Line((8707.970485, 19239.94245, 0), (8707.970485, 11800, 0)), Line((8707.970485, 19239.94245, 0), (6134.084814, 19239.94245, 0)), Line((6307.970485, 28947.82669, 0), (400, 28947.82669, 0)), Line((400, 28947.82669, 0), (400, 9809.791898, 0)), Line((400, 28947.82669, 0), (400, 9809.791898, 0)), Line((400, 28947.82669, 0), (400, 9809.791898, 0)), Line((400, 9809.791898, 0), (6707.970485, 9809.791898, 0)), Line((400, 9809.791898, 0), (6707.970485, 9809.791898, 0))], {2}: [Line((8707.970485, 19239.94245, 0), (8707.970485, 11800, 0)), Line((8707.970485, 19239.94245, 0), (6134.084814, 19239.94245, 0)), Line((6307.970485, 28947.82669, 0), (400, 28947.82669, 0)), Line((400, 28947.82669, 0), (400, 9809.791898, 0)), Line((400, 28947.82669, 0), (400, 9809.791898, 0)), Line((400, 28947.82669, 0), (400, 9809.791898, 0)), Line((400, 9809.791898, 0), (6707.970485, 9809.791898, 0)), Line((400, 9809.791898, 0), (6707.970485, 9809.791898, 0))], {3}: [Line((8707.970485, 19239.94245, 0), (8707.970485, 11800, 0)), Line((8707.970485, 19239.94245, 0), (6134.084814, 19239.94245, 0)), Line((6307.970485, 28947.82669, 0), (400, 28947.82669, 0)), Line((400, 28947.82669, 0), (400, 9809.791898, 0)), Line((400, 28947.82669, 0), (400, 9809.791898, 0)), Line((400, 28947.82669, 0), (400, 9809.791898, 0)), Line((400, 9809.791898, 0), (6707.970485, 9809.791898, 0)), Line((400, 9809.791898, 0), (6707.970485, 9809.791898, 0))], {4}: [Line((8707.970485, 19239.94245, 0), (8707.970485, 11800, 0)), Line((6307.970485, 19444.43619, 0), (6307.970485, 28947.82669, 0)), Line((6307.970485, 28947.82669, 0), (400, 28947.82669, 0)), Line((400, 28947.82669, 0), (400, 9809.791898, 0)), Line((400, 28947.82669, 0), (400, 9809.791898, 0)), Line((400, 28947.82669, 0), (400, 9809.791898, 0)), Line((400, 9809.791898, 0), (6707.970485, 9809.791898, 0)), Line((400, 9809.791898, 0), (6707.970485, 9809.791898, 0))], {5}: [Line((8707.970485, 19239.94245, 0), (8707.970485, 11800, 0)), Line((6307.970485, 19444.43619, 0), (6307.970485, 28947.82669, 0)), Line((6307.970485, 28947.82669, 0), (400, 28947.82669, 0)), Line((400, 28947.82669, 0), (400, 9809.791898, 0)), Line((400, 28947.82669, 0), (400, 9809.791898, 0)), Line((400, 28947.82669, 0), (400, 9809.791898, 0)), Line((400, 9809.791898, 0), (6707.970485, 9809.791898, 0)), Line((7107.970485, 9800, 0), (13107.97048, 9800, 0))]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))
directions = Vector(Tree({0;0;0}: [Vector(-400, 0, 0), Vector(-7439.942454, 0, 0), Vector(0, -5907.970485, 0), Vector(-19138.03479, 0, 0), Vector(-19138.03479, 0, 0), Vector(-19138.03479, 0, 0), Vector(0, -6307.970485, 0), Vector(0, -6307.970485, 0)], {0;1;0}: [Vector(-7439.942454, 0, 0), Vector(0, -2573.885671, 0), Vector(0, -5907.970485, 0), Vector(-19138.03479, 0, 0), Vector(-19138.03479, 0, 0), Vector(-19138.03479, 0, 0), Vector(0, -6307.970485, 0), Vector(0, -6307.970485, 0)], {0;2;0}: [Vector(-7439.942454, 0, 0), Vector(0, -2573.885671, 0), Vector(0, -5907.970485, 0), Vector(-19138.03479, 0, 0), Vector(-19138.03479, 0, 0), Vector(-19138.03479, 0, 0), Vector(0, -6307.970485, 0), Vector(0, -6307.970485, 0)], {0;3;0}: [Vector(-7439.942454, 0, 0), Vector(0, -2573.885671, 0), Vector(0, -5907.970485, 0), Vector(-19138.03479, 0, 0), Vector(-19138.03479, 0, 0), Vector(-19138.03479, 0, 0), Vector(0, -6307.970485, 0), Vector(0, -6307.970485, 0)], {0;4;0}: [Vector(-7439.942454, 0, 0), Vector(-9503.390494, -1.818989404e-12, 0), Vector(0, -5907.970485, 0), Vector(-19138.03479, 0, 0), Vector(-19138.03479, 0, 0), Vector(-19138.03479, 0, 0), Vector(0, -6307.970485, 0), Vector(0, -6307.970485, 0)], {0;5;0}: [Vector(-7439.942454, 0, 0), Vector(-9503.390494, -1.818989404e-12, 0), Vector(0, -5907.970485, 0), Vector(-19138.03479, 0, 0), Vector(-19138.03479, 0, 0), Vector(-19138.03479, 0, 0), Vector(0, -6307.970485, 0), Vector(0, -6000, 0)]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))
mergesetsbyinter = GhPythonScript(Code=file, Curves=curves, Directions=directions)  # -> Out, A, B
panel = Panel(mergesetsbyinter.B)
panel_2 = Panel(mergesetsbyinter.A)
