# Grasshopper definition TestGeometry.gh (Grasshopper 1.0.7)

# ----
# Grid size
grid_size = Slider(13, range=0..100)

# ----
# Grid count -1
y_count = Slider(8, range=0..100)
x_count = Slider(13, range=0..100)

# ----
# Move
x_move = Slider(0, range=0..100)

# ----
# Test geometry
x_move_2 = Data(x_move)

# ----
# Grid points
grid_size_2 = Data(grid_size)
pt = ConstructPoint(XCoordinate=x_move_2, YCoordinate=0, ZCoordinate=0)
vec = VectorXYZ(XComponent=grid_size_2, YComponent=grid_size_2, ZComponent=0)  # -> Vector, Length
move = Move(Geometry=pt, Motion=vec.Vector)  # -> Geometry, Transform
box = Box2Pt(PointA=pt, PointB=move.Geometry, Plane=PlaneXY(0, 0, 0))
x_count_2 = Data(x_count)
y_count_2 = Data(y_count)
arrbox = BoxArray(Geometry=pt, Cell=box, XCount=x_count_2, YCount=y_count_2, ZCount=1)  # -> Geometry, Transform
grid_points = Point(arrbox.Geometry)

# ----
# Grid center points
box_2 = Data(box)
project = Project(Geometry=box_2, Plane=PlaneXY(0, 0, 0))  # -> Geometry, Transform
x_count_3 = Data(x_count)
y_count_3 = Data(y_count)
pcen = PolygonCenter(Polyline=project.Geometry)  # -> CenterV, CenterE, CenterA
arrbox_2 = BoxArray(Geometry=pcen.CenterV, Cell=box_2, XCount=expr("x-1", x_count_3), YCount=expr("x-1", y_count_3), ZCount=1)  # -> Geometry, Transform
center_points = Point(arrbox_2.Geometry)

# ----
# Grid
center_points_2 = Point(center_points)
grid_points_2 = Point(grid_points)
cps = ClosestPoints(Point=center_points_2, Cloud=grid_points_2, Count=4)  # -> simplify(ClosestPoint), CPIndex, Distance
pline = PolyLine(Vertices=cps.ClosestPoint, Closed=True)  # -> flatten(Polyline)

# ----
# Sorting
center_points_3 = Point(center_points)
sort_pt = SortPoints(Points=center_points_3)  # -> Points, Indices
sorted_indices = Data(sort_pt.Indices)
sorted_points = Point(sort_pt.Points)

# ----
# Annotation
panel = Panel("""Rays chasing building elements
Rays shooting tracking points on boundaries
Rays shooting regions
Particles swimming to the edges of rooms
Balloons inflated inside rooms - creating regions
Distance fields offset to the best possible solution
Distance fields to point cloud""")
grid_y_count = Data(y_count)
series = Series(Start=0, Step=1, Count=expr("x-1", grid_y_count))
sorted_center_points = Point(sort_pt.Points)
item = ListItem(List=sorted_center_points, Index=series, Wrap=True)
annotation_serie = Data(series)
tag = TextTag3D(Location=item, Text=panel, Size=2, Justification=6)

# ----
# Column series
sorted_points_2 = Point(sorted_points)
lng = ListLength(List=sorted_points_2)
annotation_serie_2 = Data(annotation_serie)
series_2 = Series(Start=0, Step=1, Count=lng)
sorted_indices_2 = Data(sorted_indices)
lng_2 = ListLength(List=annotation_serie_2)
cull_i = CullIndex(List=series_2, Indices=annotation_serie_2, Wrap=True)
item_2 = ListItem(List=sorted_indices_2, Index=cull_i, Wrap=True)
partition = PartitionList(List=item_2, Size=lng_2)
grid_curves = Curve(pline)
item_3 = ListItem(List=grid_curves, Index=partition, Wrap=True)  # -> simplify(Item)
# Cull pattern: Any ray distance below threshold
# Cull pattern: Any ray in list has not hit an object
columns = Data(item_3)

# ----
# Column 3
columns_2 = Data(columns)
room_offset = Slider(-2, range=-4..0)
path = ConstructPath(Indices="2")
branch = TreeBranch(Tree=columns_2, Path=path, MaintainPaths=True)
offset = OffsetCurve(Curve=branch, Distance=room_offset, Plane=PlaneXY(0, 0, 0), Corners=1)
pcen_2 = PolygonCenter(Polyline=offset)  # -> CenterV, CenterE, CenterA
explode = Explode(Curve=offset, Recursive=True)  # -> Segments, Vertices
rec_2pt = Rectangle2Pt(Plane=PlaneXY(0, 0, 0), PointA=pcen_2.CenterE, PointB=explode.Vertices, Radius=0)  # -> Rectangle, Length
join = JoinCurves(Curves=rec_2pt.Rectangle, Preserve=False)
column_size = Slider(0.5, range=0.1..1)
pcen_3 = PolygonCenter(Polyline=join)  # -> CenterV, CenterE, CenterA
item_4 = ListItem(List=pcen_3.CenterV, Index=0, Wrap=True)
polygon = Polygon(Plane=item_4, Radius=column_size, Segments=4, FilletRadius=0)  # -> Polygon, Length

# ----
# Column 1
columns_3 = Data(columns)
room_offset_2 = Slider(-3, range=-4..0)
path_2 = ConstructPath(Indices="0")
branch_2 = TreeBranch(Tree=columns_3, Path=path_2, MaintainPaths=True)
offset_2 = OffsetCurve(Curve=branch_2, Distance=room_offset_2, Plane=PlaneXY(0, 0, 0), Corners=1)

# ----
# Column 2
columns_4 = Data(columns)
room_offset_3 = Slider(-2, range=-4..0)
path_3 = ConstructPath(Indices="1")
branch_3 = TreeBranch(Tree=columns_4, Path=path_3, MaintainPaths=True)
offset_3 = OffsetCurve(Curve=branch_3, Distance=room_offset_3, Plane=PlaneXY(0, 0, 0), Corners=1)
pcen_4 = PolygonCenter(Polyline=offset_3)  # -> CenterV, CenterE, CenterA
explode_2 = Explode(Curve=offset_3, Recursive=True)  # -> Segments, Vertices
rec_2pt_2 = Rectangle2Pt(Plane=PlaneXY(0, 0, 0), PointA=pcen_4.CenterE, PointB=explode_2.Vertices, Radius=0)  # -> Rectangle, Length
join_2 = JoinCurves(Curves=rec_2pt_2.Rectangle, Preserve=False)
