# Grasshopper definition distance_fields+ordered_points.gh (Grasshopper 1.0.7)

# ----
# Variables
threshold = Slider(250, range=0..10000)
cell_size = Slider(200, range=0..10000)
height = Slider(3000, range=0..3000)
threshold_2 = Data(threshold)
cell_size_2 = Data(cell_size)

# ----
# Test geometry
surfaces_to_test = Brep([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])
curved_rooms = Curve([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])
std_test_room = Curve([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])
mesh_to_test = Mesh([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])

# ----
# Her er ændret
# Beskrivelse er i rapport
# Gh skal også uploades i components!!!
# distance_fields+ordered_grid
floor_plan = FloorPlan(geometry=std_test_room, height=Slider(30000, range=0..100000))

# ----
# Control geometry
crv = Curve([<curve referenced from the Rhino model> x5])
area = Area(Geometry=crv)  # -> Area, Centroid; disabled
sort = SortList(Keys=area.Area)  # -> Keys, ValuesA; disabled

# ----
# Preparation
point_grid = PointGrid(floor_plan=floor_plan, cell_size=cell_size_2)  # -> point_grid_2, corners_2
remove_points_near_walls = RemovePointsNearWalls(point_grid=point_grid.point_grid_2, floor_plan=floor_plan, threshold=threshold_2)
points_grouped_in_rooms = PointsGroupedInRooms(modified_point_grid=remove_points_near_walls, cell_size=cell_size_2)
remove_groups_outside_geometry = RemoveGroupsOutsideGeometry(corner_points=point_grid.corners_2, grouped_points=points_grouped_in_rooms)

pt = Point(point_grid.corners_2)
floor_plan_2 = Data(floor_plan)

# ----
# Registration of space boundary data
path = FilePath("C:\Users\ander\Git\space-invader\components\nakedEdges.py")
nakededges = NakedEdges(F=path, roomed_points=remove_groups_outside_geometry, cell_size=cell_size_2)
pull_nakededges_vertices = PullNakedEdgesVertices(room_boundaries=nakededges, floor_plan=floor_plan_2)

explode = Explode(Curve=floor_plan_2, Recursive=True)  # -> Segments, Vertices

# ----
# Clean-up
shatter_floor_plans = ShatterFloorPlans(floor_plan=explode.Segments)

# ----
# Her er ændret
# Frasortere det fjerneste punkt, hvis to punkter rykker til "samme" punkt
pull_closest_points_to_corners = PullClosestPointsToCorners(shatted_wall_lines=shatter_floor_plans, closest_points=pull_nakededges_vertices)

# ----
# Cull pattern: Any ray distance below threshold
# Reconstruction of room geometry
room_surfaces = RoomSurfaces(sorted_culled_points=pull_closest_points_to_corners)

# ----
# Control
room_mesh = Data(room_surfaces)  # disabled
area_2 = Area(Geometry=flatten(room_mesh))  # -> Area, Centroid; disabled
sort_2 = SortList(Keys=area_2.Area)  # -> Keys, ValuesA; disabled

# ----
# Totalafvigelse i procent
ma = MassAddition(Input=sort_2.Keys)  # -> Result, PartialResults; disabled
ma_2 = MassAddition(Input=sort.Keys)  # -> Result, PartialResults; disabled
subtraction = Subtraction(A=ma.Result, B=ma_2.Result)  # disabled
abs = Absolute(Value=subtraction)  # disabled
number_slider = Slider(100, range=0..100)  # disabled
division = Division(A=abs, B=ma_2.Result)  # disabled
multiplication = Multiplication(A=division, B=number_slider)  # disabled
panel = Panel(multiplication)  # disabled

# ----
# Afvigelse pr. rum
subtraction_2 = Subtraction(A=sort_2.Keys, B=sort.Keys)  # disabled
abs_2 = Absolute(Value=subtraction_2)  # disabled
number_slider_2 = Slider(100, range=0..100)  # disabled
division_2 = Division(A=abs_2, B=sort.Keys)  # disabled
multiplication_2 = Multiplication(A=division_2, B=number_slider_2)  # disabled
panel_2 = Panel(multiplication_2)  # disabled

Z = UnitZ(Factor=Slider(2800, range=2000..3000))
# Cull pattern: Any ray in list has not hit an object
# Afvigelse pr. rum
# Totalafvigelse i procent
# Afvigelse pr. rum
# Offset curves w. average distance to closest wall line
# Totalafvigelse i procent
extr = Extrude(Base=room_surfaces, Direction=Z)

# ==== cluster RemoveGroupsOutsideGeometry
corner_points = ClusterInput()
grouped_points = ClusterInput()

# ----
# Remove groups of points containing corners
corner_points_2 = Point(flatten(corner_points))
grouped_points_2 = Point(grouped_points)
lng = ListLength(List=grouped_points_2)
intersection = SetIntersection(SetA=corner_points_2, SetB=grouped_points_2)
lng_2 = ListLength(List=intersection)
larger = LargerThan(FirstNumber=lng, SecondNumber=Slider(30, range=0..100))  # -> LargerThan, OrEqualTo
equals = Equality(FirstNumber=lng_2, SecondNumber=Slider(0, range=0..100))  # -> Equality, Inequality
and = GateAnd(A=equals.Equality, B=larger.LargerThan)
cull = CullPattern(List=grouped_points_2, CullPattern=and)
clean = CleanTree(RemoveNulls=True, RemoveInvalid=True, RemoveEmpty=True, Tree=cull)
grouped_points_3 = Point(clean)

grouped_points_4 = ClusterOutput(grouped_points_3)

# ==== cluster RemovePointsNearWalls
point_grid = ClusterInput()
floor_plan = ClusterInput()
threshold = ClusterInput()

# ----
# Cull points closer than threshold to walls
point_grid_2 = Point(point_grid)
floor_plan_2 = Curve(floor_plan)
pull = PullPoint(Point=point_grid_2, Geometry=simplify(floor_plan_2), ClosestOnly=True)  # -> ClosestPoint, Distance
flip = FlipMatrix(Data=pull.Distance)
sort = SortList(Keys=flip)  # -> Keys, ValuesA
item = ListItem(List=sort.Keys, Index=0, Wrap=True)  # -> flatten(Item)
threshold_2 = Data(threshold)
larger = LargerThan(FirstNumber=item, SecondNumber=threshold_2)  # -> LargerThan, OrEqualTo
cull = CullPattern(List=point_grid_2, CullPattern=larger.LargerThan)
modified_point_grid = Point(cull)

modified_point_grid_2 = ClusterOutput(modified_point_grid)

# ==== cluster PointsGroupedInRooms
modified_point_grid = ClusterInput()
cell_size = ClusterInput()

# ----
# Grouping points and proximity
cell_size_2 = Data(cell_size)
modified_point_grid_2 = Point(modified_point_grid)
expression = Expression(a=cell_size_2, Expression="sqrt(a^2+a^2)+0.01")
pgroups = PointGroups(Points=modified_point_grid_2, Distance=expression)  # -> simplify(Groups), Indices
grouped_points = Point(pgroups.Groups)

grouped_points_2 = ClusterOutput(grouped_points)

# ==== cluster PointGrid
floor_plan = ClusterInput()

# ----
# Extreme points
floor_plan_2 = Curve(floor_plan)
explode = Explode(Curve=floor_plan_2, Recursive=True)  # -> Segments, flatten(Vertices)
bnd = Bounds2D(Coordinates=explode.Vertices)
dedom2 = DeconstructDomain²(Domain=bnd)  # -> UComponent, VComponent
dedomain = DeconstructDomain(Domain=dedom2.VComponent)  # -> Start, End
dedomain_2 = DeconstructDomain(Domain=dedom2.UComponent)  # -> Start, End
min_y = Number(dedomain.Start)
min_x = Number(dedomain_2.Start)
max_x = Number(dedomain_2.End)
max_y = Number(dedomain.End)

cell_size = ClusterInput()

# ----
# Point Grid
min_y_2 = Number(min_y)
min_x_2 = Number(min_x)
max_x_2 = Number(max_x)
max_y_2 = Number(max_y)
cell_size_2 = Number(cell_size)
pt = ConstructPoint(XCoordinate=min_x_2, YCoordinate=min_y_2, ZCoordinate=0)
vec = VectorXYZ(XComponent=cell_size_2, YComponent=cell_size_2, ZComponent=0)  # -> Vector, Length
rev = Reverse(Vector=vec.Vector)
subtraction = Subtraction(A=max_y_2, B=min_y_2)
subtraction_2 = Subtraction(A=max_x_2, B=min_x_2)
move = Move(Geometry=pt, Motion=rev)  # -> Geometry, Transform
division = Division(A=subtraction, B=cell_size_2)
division_2 = Division(A=subtraction_2, B=cell_size_2)
round = Round(Number=division)  # -> Nearest, Floor, Ceiling
round_2 = Round(Number=division_2)  # -> Nearest, Floor, Ceiling
addition = Addition(A=round_2.Ceiling, B="2")
addition_2 = Addition(A=round.Ceiling, B="2")
sqgrid = Square(Plane=move.Geometry, Size=cell_size_2, ExtentX=addition, ExtentY=addition_2)  # -> Cells, Points
num = Number(addition)
num_2 = Number(addition_2)
point_grid = Point(flatten(sqgrid.Points))
item = TreeItem(Tree=simplify(sqgrid.Points), Path=graft(["0", num]), Index=["0", num_2], Wrap=True)
corners = Point(flatten(item))

point_grid_2 = ClusterOutput(point_grid)
corners_2 = ClusterOutput(corners)

# ==== cluster ShatterFloorPlans
floor_plan = ClusterInput()

# ----
# Find Closest points that are not endpoints and are within the distance limit
floor_plan_2 = Curve(floor_plan)
crv = Curve(reparameterize(flatten(floor_plan_2)))
end = EndPoints(Curve=crv)  # -> Start, End
crv_cp = CurveClosestPoint(Point=simplify(graft([end.Start, end.End])), Curve=reparameterize(crv))  # -> Point, Parameter, Distance
smaller = SmallerThan(FirstNumber=crv_cp.Distance, SecondNumber=Slider(500, range=0..1000))  # -> SmallerThan, OrEqualTo
larger = LargerThan(FirstNumber=crv_cp.Parameter, SecondNumber="1-1e-3")  # -> LargerThan, OrEqualTo
smaller_2 = SmallerThan(FirstNumber=crv_cp.Parameter, SecondNumber="1e-3")  # -> SmallerThan, OrEqualTo
or = GateOr(A=larger.LargerThan, B=smaller_2.SmallerThan)
not = GateNot(A=or)
parameters = Number(simplify(crv_cp.Parameter))
and = GateAnd(A=not, B=smaller.SmallerThan)  # -> simplify(Result)
path_mapper = PathMapper(and, source="{A}(B)", target="{B}(A)")
path_mapper_2 = PathMapper(parameters, source="{A}(B)", target="{B}(A)")
any = AnyTrue(values=path_mapper)  # -> flatten(any_true)
cull = CullPattern(List=simplify(path_mapper_2), CullPattern=simplify(path_mapper))
not_2 = GateNot(A=any)
shatter = Shatter(Curve=graft(crv), Parameters=cull)
cull_2 = CullPattern(List=simplify(crv), CullPattern=not_2)
shattered_curves = Curve(shatter)
curves_to_keep = Curve(cull_2)
merge = Merge(Data1=flatten(shattered_curves), Data2=flatten(curves_to_keep))
shatted_floor_plans = Curve(merge)

explode = Explode(Curve=crv, Recursive=True)  # -> Segments, Vertices
shatted_floor_plans_2 = ClusterOutput(shatted_floor_plans)

# ==== cluster PullNakedEdgesVertices
room_boundaries = ClusterInput()
floor_plan = ClusterInput()

# ----
# Pull concave verticies to nearest floor plan geometry
room_boundaries_2 = Curve(room_boundaries)
floor_plan_2 = Curve(floor_plan)
simplify = SimplifyCurve(Curve=room_boundaries_2)  # -> Curve, Simplified
explode = Explode(Curve=simplify.Curve, Recursive=True)  # -> Segments, Vertices
pull = PullPoint(Point=explode.Vertices, Geometry=flatten(floor_plan_2), ClosestOnly=True)  # -> ClosestPoint, Distance
closest_points = Point(pull.ClosestPoint)

closest_points_2 = ClusterOutput(closest_points)

# ==== cluster PullClosestPointsToCorners
closest_points = ClusterInput()

# ----
# Cull points with an angle larger than 170 degrees
closest_points_2 = Point(closest_points)
cullpt = CullDuplicates(Points=closest_points_2, Tolerance=0.1, CullMode=3)  # -> Points, Indices, Valence
shift = ShiftList(List=cullpt.Points, Shift=-1, Wrap=True)
shift_2 = ShiftList(List=cullpt.Points, Shift=1, Wrap=True)
vec2pt = Vector2Pt(PointA=cullpt.Points, PointB=shift_2, Unitize=False)  # -> Vector, Length
vec2pt_2 = Vector2Pt(PointA=cullpt.Points, PointB=shift, Unitize=False)  # -> Vector, Length
angle = Angle(VectorA=vec2pt.Vector, VectorB=vec2pt_2.Vector)  # -> Angle, Reflex
deg = Degrees(Radians=angle.Angle)
smaller = SmallerThan(FirstNumber=deg, SecondNumber=Slider(170, range=0..1000))  # -> SmallerThan, OrEqualTo
cull = CullPattern(List=cullpt.Points, CullPattern=smaller.SmallerThan)
points_pulled_onto_floor_plan = Point(cullpt.Points)
corner_points_to_replace = Point(cull)

shatted_wall_lines = ClusterInput()

# ----
# Replace closest "corner" points with end points
points_pulled_onto_floor_plan_2 = Point(points_pulled_onto_floor_plan)
corner_points_to_replace_2 = Point(corner_points_to_replace)
shatted_wall_lines_2 = Curve(shatted_wall_lines)
end = EndPoints(Curve=shatted_wall_lines_2)  # -> Start, End

# ----
# Remove points farthest moved to same point
cullpt_2 = CullDuplicates(Points=[end.Start, end.End], Tolerance=5, CullMode=3)  # -> Points, Indices, Valence

cp = ClosestPoint(Point=corner_points_to_replace_2, Cloud=cullpt_2.Points)  # -> ClosestPoint, CPIndex, Distance

remove_points_farthest_moved_to_same_poi = GhPythonScript(x=cp.CPIndex, y=cp.Distance)  # -> out, a; "Remove points farthest moved to same point"; inputs x: list, y: list
# ---------- remove_points_farthest_moved_to_same_poi: Python ----------
# Creates a cull pattern starts with everything true.
# If any two indecies of the closest point is the same
# the point farthest away is set to false 
mapping = [True] * len(x)
for i, elem in enumerate(x):
    try:
        j = x.index(elem, i + 1)  # look ahead
        mapping[i] = y[i]<y[j]
        mapping[j] = y[j]<y[i]
    except ValueError: # no match found
        pass
a = mapping
# ---------- end remove_points_farthest_moved_to_same_poi ----------
cull_2 = CullPattern(List=cp.ClosestPoint, CullPattern=remove_points_farthest_moved_to_same_poi.a)
cull_3 = CullPattern(List=corner_points_to_replace_2, CullPattern=remove_points_farthest_moved_to_same_poi.a)

replace = ReplaceMembers(Set=points_pulled_onto_floor_plan_2, Find=cull_3, Replace=cull_2)
sorted_culled_points = Point(replace)

sorted_culled_points_2 = ClusterOutput(sorted_culled_points)

# ==== cluster RoomSurfaces
sorted_culled_points = ClusterInput()

# ----
# Create Surface
sorted_culled_points_2 = Point(sorted_culled_points)
pline = PolyLine(Vertices=sorted_culled_points_2, Closed=True)
boundary = BoundarySurfaces(Edges=pline)
room_surfaces = Data(boundary)

room_surfaces_2 = ClusterOutput(room_surfaces)

# ==== cluster NakedEdges
roomed_points = ClusterInput()
cell_size = ClusterInput()
# Naked Edges
cell_size_2 = Data(cell_size)
expression = Expression(a=cell_size_2, Expression="sqrt(a^2+a^2)+0.01")
roomed_points_2 = Point(roomed_points)
F = ClusterInput()
file = ReadFile(File=F, PerLineParse=False)
nakededges = PythonScript(Code=file, Points=roomed_points_2, Threshold=expression)  # -> Out, NakedEdges
nakededges_2 = Curve(nakededges.NakedEdges)
nakededges_3 = ClusterOutput(nakededges_2)

# ==== cluster FloorPlan
geometry = ClusterInput()
height = ClusterInput()

# ----
# Geometry input to floor plan
geometry_2 = Data(geometry)
height_2 = Data(height)
floor_plan = GhPythonScript(geometry=geometry_2, height=height_2)  # -> out, a; inputs geometry: list
# ---------- floor_plan: Python ----------
import System
import clr
clr.AddReference("Grasshopper")
import rhinoscriptsyntax as rs
from Grasshopper import DataTree
import Rhino.Geometry as rg
import ghpythonlib.components as ghc
import ghpythonlib.treehelpers as ght

#a = DataTree[System.Object]()
a = []
# Checks whether the input geometry is brep, mesh or curve
# If it is a brep or mesh, the input height is used to create the contour, in 
# the given height
# Curves are then projected onto world xy-plane
for i in range (len(geometry)):
    if (geometry[i].ToString().split(".")[-1]).Contains("Brep"):
        a.Add(geometry[i].CreateContourCurves(geometry[i],rs.MovePlane(rs.WorldXYPlane(),[0,0,height])))
    elif (geometry[i].ToString().split(".")[-1]).Contains("Mesh"):
        a.Add(geometry[i].CreateContourCurves(geometry[i],rs.MovePlane(rs.WorldXYPlane(),[0,0,height])))
    elif (geometry[i].ToString().split(".")[-1]).Contains("Curve"):
        a.Add(geometry[i].ProjectToPlane(geometry[i],rs.WorldXYPlane()))

a = ght.list_to_tree(a)
a.Flatten()
# ---------- end floor_plan ----------
project = Project(Geometry=floor_plan.a, Plane=PlaneXY(0, 0, 0))  # -> Geometry, Transform
floor_plan_2 = Curve(project.Geometry)

floor_plan_3 = ClusterOutput(floor_plan_2)

# ==== cluster AnyTrue: Returns True if any input value is True
values = ClusterInput()
ma = MassAddition(Input=values)  # -> Result, PartialResults
larger = LargerThan(FirstNumber=ma.Result, SecondNumber=Slider(1, range=0..1))  # -> LargerThan, simplify(OrEqualTo)
any_true = ClusterOutput(larger.OrEqualTo)
