# Grasshopper definition example.gh (Grasshopper 1.0.7)

# ----
# Variables
threshold = Slider(250, range=0..10000)
cell_size = Slider(300, range=0..10000)
height = Slider(500, range=0..100000)
threshold_2 = Data(threshold)
cell_size_2 = Data(cell_size)

# ----
# example
# Test geometry
example_house = Mesh(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)

# ----
# Preparation
floorplan = FloorPlan(geometry=example_house, height=height)
pointgrid = PointGrid(floor_plan=floorplan, cell_size=cell_size_2)  # -> point_grid_2, corners_2

# ----
# Distance fields
floor_plan = Data(floorplan)
distancefields = DistanceFields(
    corner_points=pointgrid.corners_2,
    point_grid=pointgrid.point_grid_2,
    floor_plan=floor_plan,
    threshold=threshold_2,
    cell_size=cell_size_2)

# ----
# Ordered points
nakededges = NakedEdgesOfPointCollection(roomed_points=distancefields, cell_size=cell_size_2)

# ----
# Clean-up
# Correction step - Solution 1 & 2
floor_plan_2 = Data(floorplan)
shatternearby = ShatterNearbyCurves(C=floor_plan_2, distance=threshold_2)

# ----
# 1. Offset by distance field and pull
# approximated distance field boundary
# corners
floor_plan_3 = Data(floorplan)
offsetdfmovedfcorners = OffsetByDistanceFieldsMoveCorners(shatted_floor_plans=shatternearby, naked_edges=nakededges, floor_plan=floor_plan_3)

# ----
# 2. Offset by average distance field
floor_plan_4 = Data(floorplan)
offsetbyaveragedf = OffsetByTheAverageDistanceField(C=nakededges, G=floor_plan_4)

# ----
# Reconstruction of room geometry
boundary = BoundarySurfaces(Edges=flatten(offsetbyaveragedf))
height_2 = Slider(2800, range=2000..3000)
Z = UnitZ(Factor=height_2)
extr = Extrude(Base=boundary, Direction=Z)

# ----
# Reconstruction of room geometry
pntsrf = SurfaceFromPointTrail(sorted_culled_points=offsetdfmovedfcorners)
height_3 = Slider(2800, range=2000..3000)
Z_2 = UnitZ(Factor=height_3)
extr_2 = Extrude(Base=pntsrf, Direction=Z_2)

# ----
# Connectivity
number_slider = Slider(706, range=0..1000)
sample_distance = Slider(1000, range=200..5000)
srf = Surface(flatten(pntsrf))
connectivity = RoomConnectivityGraph(rooms=srf, distance=number_slider, sample=sample_distance)  # -> graph; inputs rooms: list
# ---------- connectivity: Python ----------
""" Find the adjacent rooms for each room. The returned adjecency graph will
contain a list for each room containing the indices of the rooms that are
adjacent to it.
Input:
    rooms [brep] - Surfaces of the rooms to analyze
    distance [value] - Distance from the room to check for other rooms
    sample [value] - Distance between sample points (lower = more points)
Returns:
    connectivity [index] - Room connectivity in adjacency graph representation
"""
import rhinoscriptsyntax as rs
import ghpythonlib.components as ghc
import Rhino.Geometry as rg
import ghpythonlib.treehelpers as ght

# Create output List
connectivity = []
P = []
# Define global tool objects
reparam = rg.Interval(0,1)
global_Z = rg.Vector3d(0,0,1)
global_Z_neg = ghc.Reverse(global_Z)
global_XY = ghc.XYPlane(ghc.ConstructPoint(0,0,0))


def standardize_surfaces(srf):
    srf = ghc.ProjectAlong(srf, global_XY, global_Z_neg)[0]
    srf_normal = ghc.EvaluateSurface(srf, ghc.ConstructPoint(0.5,0.5,0))[1]
    if srf_normal[2] < 0:
        return ghc.Flip(srf)[0]
    else:
        return srf

def create_outside_points(segment):
    # Create a point mid-curve outside the region
    n_pts = max(int(segment.GetLength()/sample),1)
    curve_points, tangents, _ = ghc.DivideCurve(segment, n_pts, False)
    if n_pts > 1:
        points = []
        for curve_point in curve_points[1:-1]:
            normal = ghc.CrossProduct(tangents[0], global_Z, True)
            curve_point, _ = ghc.Move(curve_point, normal[0]*distance)
            points.append(curve_point)
        return points
    else:
        segment.Domain = reparam
        normal = ghc.CrossProduct(tangents, global_Z, True)
        curve_point = ghc.EvaluateCurve(segment,0.5)[0]
        curve_point, _ = ghc.Move(curve_point, normal[0][0]*distance)
        return [curve_point]

# Standardize surfaces
rooms = [standardize_surfaces(room) for room in rooms]

# Convert brep to polylines
room_segments = [ghc.DeconstructBrep(room)[1] for room in rooms]
room_polylines = [ghc.JoinCurves(segments, True) for segments in room_segments]

# Main script
for i, room_polyline in enumerate(room_polylines):
    connect = set()
    for segment in room_segments[i]:
        points = create_outside_points(segment)
        P.append(points)
        if type(points) in [list, tuple]:
            for p in points:
                for j, pl in enumerate(room_polylines):
                    if j not in connect:
                        relation, _ = ghc.PointInCurve(p, pl)
                        if relation > 0:
                            connect.add(j)
    connectivity.append(list(connect))


# Convert outputs to trees
R = ght.list_to_tree(rooms)
P = ght.list_to_tree(P)
graph = ght.list_to_tree(connectivity)
# ---------- end connectivity ----------
panel = Panel(connectivity)

# ----
# Room tags
number_slider_2 = Slider(-1000, range=-1000..1)
vec = VectorXYZ(XComponent=0, YComponent=number_slider_2, ZComponent=0)  # -> Vector, Length
area = Area(Geometry=srf)  # -> Area, Centroid
division = Division(A=area.Area, B="10^6")
round = Round(Number=division)  # -> Nearest, Floor, Ceiling
move = Move(Geometry=area.Centroid, Motion=vec.Vector)  # -> Geometry, Transform
lng = ListLength(List=area.Centroid)
concat = Concatenate(FragmentA=round.Nearest, FragmentB=" m^2")
series = Series(Start=0, Step=1, Count=lng)
tag = TextTag(Location=area.Centroid, Text=series)
tag_2 = TextTag(Location=move.Geometry, Text=concat)

# ----
# gbXML export
panel_2 = Panel("C:\Users\ander\Desktop\New folder\test.xml")
extruded_surfaces = Brep(extr_2)
gbxml = ExportSolidsToGbXML(rooms=extruded_surfaces, path=panel_2)  # inputs rooms: list
# ---------- gbxml: Python ----------
""" Export rooms to gbXML
Input:
    rooms [brep] - Solid of the rooms to export
    path [path] - Place to save the gbXML
"""
import rhinoscriptsyntax as rs
import ghpythonlib.components as ghc
import Rhino.Geometry as rg
import ghpythonlib.treehelpers as ght

def brep_area(brep, plane):
    """ Computes plane area of a brep"""
    section_curve = ghc.BrepXPlane(brep,plane)[0]
    area = ghc.Area(section_curve)[0]
    return area

def get_spatial_data(breps):
    """ Creates a dictionary with volume and area of the breps"""
    spatial_data = {"area":[],"volume":[]}
    for i, room_brep in enumerate(breps):
        # Get volume
        room_volume, room_centroid = ghc.Volume(room_brep)
        spatial_data["volume"].append(int(room_volume))
        # Get Area
        room_area = brep_area(room_brep, ghc.XYPlane(room_centroid))
        spatial_data["area"].append(int(room_area))
    return spatial_data

def brep_polyloops(brep):
    """ Returns the polyloop of all faces for a brep"""
    faces = ghc.DeconstructBrep(brep)[0]
    polyloops = []
    for face in faces:
        edges = ghc.DeconstructBrep(face)[1]
        polyline = ghc.JoinCurves(edges, False)
        vertices = ghc.Explode(polyline, recursive=True)[1]
        polyloops.append(vertices)
    return polyloops

def room_xml_string(room_brep, i):
    # Header for string concatenation
    XML_room_header = '''\n        <Space id="sp-%i-Open" zoneIdRef="zone-Default">
            <Name>%i Open</Name>
            <Area>%i</Area>
            <Volume>%i</Volume>
            <ShellGeometry id="sg-sp-%i-Open" unit="mm">
                <ClosedShell>''' %(i,i,spatial_data["area"][i],spatial_data["volume"][i],i)
    
    # Goemetry strings for string concatenation
    XML_room_polyloops = ""
    polyloops = brep_polyloops(room_brep)
    for polyloop in polyloops:
        XML_room_polyloops += "\n\t\t\t\t\t<PolyLoop>"
        for point in polyloop:
            XML_room_polyloops += "\n"+"\t"*6+"<CartesianPoint>"
            for coordinate in point:
                XML_room_polyloops += "\n"+"\t"*7+"<Coordinate>%i<Coordinate>" %int(coordinate)
            XML_room_polyloops += "\n"+"\t"*6+"</CartesianPoint>"
        XML_room_polyloops += "\n\t\t\t\t\t</PolyLoop>"
    
    # Footer for string concatenation
    XML_room_footer = '''</ClosedShell>
                <AnalyticalShell>
                </AnalyticalShell>
            </ShellGeometry>
        </Space>'''
    return XML_room_header + XML_room_polyloops + XML_room_footer


# Open file and create list to write
xml = open(path, "w")

# Get volume and area
spatial_data = get_spatial_data(rooms)

# Write header and open tags
XML_header = '''<Campus id="cmps-1">
    <Building id="bldg-1" buildingType="Office">
        <Area>%i</Area>''' % sum(spatial_data["area"])
xml.write(XML_header)

# Write rooms
for i, room_brep in enumerate(rooms):
    xml.write(room_xml_string(room_brep, i))

# Write Close tags
XML_footer = '''</Building>\n</Campus>'''
xml.write(XML_footer)

# close file
xml.close()
# ---------- end gbxml ----------

# ==== cluster FloorPlan: Creates a 2D Floor Plan using the input geometry. If the input is a brep or mesh, the input height is used to create the contour in the given height. If it is a curve, it is simply projected onto world XY-plane and outputted as a floor plan (curves).
geometry = ClusterInput()
height = ClusterInput()

# ----
# Geometry input to floor plan
geometry_2 = Data(geometry)
height_2 = Data(height)
floor_plan = GhPythonScript(geometry=geometry_2, height=height_2)  # -> out, a; inputs geometry: list
# ---------- floor_plan: Python ----------
import System
import clr
clr.AddReference("Grasshopper")
import rhinoscriptsyntax as rs
from Grasshopper import DataTree
import Rhino.Geometry as rg
import ghpythonlib.components as ghc
import ghpythonlib.treehelpers as ght

#a = DataTree[System.Object]()
a = []
# Checks whether the input geometry is brep, mesh or curve
# If it is a brep or mesh, the input height is used to create the contour, in 
# the given height
# Curves are then projected onto world xy-plane
for i in range (len(geometry)):
    if (geometry[i].ToString().split(".")[-1]).Contains("Brep"):
        a.append(geometry[i].CreateContourCurves(geometry[i],rs.MovePlane(rs.WorldXYPlane(),[0,0,height])))
    elif (geometry[i].ToString().split(".")[-1]).Contains("Mesh"):
        a.append(geometry[i].CreateContourCurves(geometry[i],rs.MovePlane(rs.WorldXYPlane(),[0,0,height])))
    elif (geometry[i].ToString().split(".")[-1]).Contains("Curve"):
        a.append(geometry[i].ProjectToPlane(geometry[i],rs.WorldXYPlane()))

a = ght.list_to_tree(a)
a.Flatten()
# ---------- end floor_plan ----------
project = Project(Geometry=floor_plan.a, Plane=PlaneXY(0, 0, 0))  # -> Geometry, Transform
floor_plan_2 = Curve(project.Geometry)

floor_plan_3 = ClusterOutput(floor_plan_2)

# ==== cluster PointGrid: Creates a 2D point grid of a given cell size, covering all the given curves (floor plan). An extra row of points is added in all directions, to make sure the grids corner points is not inside the building geometry.
floor_plan = ClusterInput()

# ----
# Extreme points
floor_plan_2 = Curve(floor_plan)
explode = Explode(Curve=floor_plan_2, Recursive=True)  # -> Segments, flatten(Vertices)
bnd = Bounds2D(Coordinates=explode.Vertices)
dedom2 = DeconstructDomain²(Domain=bnd)  # -> UComponent, VComponent
dedomain = DeconstructDomain(Domain=dedom2.VComponent)  # -> Start, End
dedomain_2 = DeconstructDomain(Domain=dedom2.UComponent)  # -> Start, End
min_y = Number(dedomain.Start)
min_x = Number(dedomain_2.Start)
max_x = Number(dedomain_2.End)
max_y = Number(dedomain.End)

cell_size = ClusterInput()

# ----
# Point Grid
min_y_2 = Number(min_y)
min_x_2 = Number(min_x)
max_x_2 = Number(max_x)
max_y_2 = Number(max_y)
cell_size_2 = Number(cell_size)
pt = ConstructPoint(XCoordinate=min_x_2, YCoordinate=min_y_2, ZCoordinate=0)
vec = VectorXYZ(XComponent=cell_size_2, YComponent=cell_size_2, ZComponent=0)  # -> Vector, Length
rev = Reverse(Vector=vec.Vector)
subtraction = Subtraction(A=max_y_2, B=min_y_2)
subtraction_2 = Subtraction(A=max_x_2, B=min_x_2)
move = Move(Geometry=pt, Motion=rev)  # -> Geometry, Transform
division = Division(A=subtraction, B=cell_size_2)
division_2 = Division(A=subtraction_2, B=cell_size_2)
round = Round(Number=division)  # -> Nearest, Floor, Ceiling
round_2 = Round(Number=division_2)  # -> Nearest, Floor, Ceiling
addition = Addition(A=round_2.Ceiling, B="2")
addition_2 = Addition(A=round.Ceiling, B="2")
sqgrid = Square(Plane=move.Geometry, Size=cell_size_2, ExtentX=addition, ExtentY=addition_2)  # -> Cells, Points
num = Number(addition)
num_2 = Number(addition_2)
point_grid = Point(flatten(sqgrid.Points))
item = TreeItem(Tree=simplify(sqgrid.Points), Path=graft(["0", num]), Index=["0", num_2], Wrap=True)
corners = Point(flatten(item))

point_grid_2 = ClusterOutput(point_grid)
corners_2 = ClusterOutput(corners)

# ==== cluster DistanceFields: Removes all points that are closer than the given threshold to any curve in the floor plan. Also groups resulting points based on internal distance, and thereby creates sets of distance fields/ordered points.
corner_points = ClusterInput()
cell_size = ClusterInput()
point_grid = ClusterInput()
floor_plan = ClusterInput()
threshold = ClusterInput()

# ----
# Distance fields
remove_points_near_walls = RemovePointsNearWalls(point_grid=point_grid, floor_plan=floor_plan, threshold=threshold)
points_grouped_in_rooms = PointsGroupedInRooms(modified_point_grid=remove_points_near_walls, cell_size=cell_size)
remove_groups_outside_geometry = RemoveGroupsOutsideGeometry(corner_points=corner_points, grouped_points=points_grouped_in_rooms)

roomed_points = ClusterOutput(remove_groups_outside_geometry)

# ==== cluster NakedEdgesOfPointCollection: Extracts the boundary edges of the point collection by Delaunay triangulation of the ordered points, and filtering edges that are above the diagonal of the cell size.
roomed_points = ClusterInput()
cell_size = ClusterInput()
# Naked Edges
cell_size_2 = Data(cell_size)
expression = Expression(a=cell_size_2, Expression="sqrt(a^2+a^2)+0.01")
roomed_points_2 = Point(roomed_points)
nakededges = PythonScript(points=roomed_points_2, threshold=expression)  # -> out, nakedEdges; inputs points: list of Point3d
# ---------- nakededges: Python ----------
import ghpythonlib.components as ghComp
import ghpythonlib.parallel as par
import rhinoscriptsyntax as rs


# DelaunayMesh and get vertices and faces
mesh = ghComp.DelaunayMesh(points,rs.WorldXYPlane())
vertices,faces,_,_ = ghComp.DeconstructMesh(mesh)

# uses faces if max distance of edges are shorter than or equal to the given threshold(cell size ^2 + 2*cell size^2)
newMesh=[]
def face_distance(face):
    dist1=rs.Distance(points[face.A],points[face.B])
    dist2=rs.Distance(points[face.B],points[face.C])
    dist3=rs.Distance(points[face.C],points[face.A])
    maxDist=max(dist1,dist2,dist3)
    if(maxDist<=threshold):
        newMesh.append(face)
par.run(face_distance,faces)

# create final meshes and use naked edges for boundary
finalMesh=ghComp.ConstructMesh(vertices,newMesh)
nakedEdges = finalMesh.GetNakedEdges()
# ---------- end nakededges ----------
nakededges_2 = Curve(nakededges.nakedEdges)
nakededges_3 = ClusterOutput(nakededges_2)

# ==== cluster OffsetByDistanceFieldsMoveCorners: Offsets each vertex in the room bounding curve with its distance to the existing floor plan curves. Identifies corners of the room bounding curve, based on internal angles between the points, and moves them to the closest end point of the floor plan curves (If any two corner points are moved to the same end point, only the closest point is moved).
naked_edges = ClusterInput()
floor_plan = ClusterInput()
pullnakededgevertices = PullNakedEdgeVertices(room_boundaries=naked_edges, floor_plan=floor_plan)
shatted_floor_plans = ClusterInput()
pullclosestpoints2corners = PullClosestPoints2Corners(shatted_wall_lines=shatted_floor_plans, closest_points=pullnakededgevertices)
ordered_points = ClusterOutput(pullclosestpoints2corners)

# ==== cluster ShatterNearbyCurves: Shatters each curve at every point on the curve that is nearest to the endpoints of other curves that are within the specified distance.
C = ClusterInput()
distance = ClusterInput()
distance_2 = Number(distance)

# ----
# Shatter curves that are near the endpoint of another curve
explode = Explode(Curve=C, Recursive=True)  # -> Segments, Vertices
crv = Curve(reparameterize(flatten(explode.Segments)))
end = EndPoints(Curve=crv)  # -> Start, End
crv_cp = CurveClosestPoint(Point=simplify(graft([end.Start, end.End])), Curve=reparameterize(crv))  # -> Point, Parameter, Distance
smaller = SmallerThan(FirstNumber=crv_cp.Distance, SecondNumber=distance_2)  # -> SmallerThan, OrEqualTo
smaller_2 = SmallerThan(FirstNumber=crv_cp.Parameter, SecondNumber="1e-3")  # -> SmallerThan, OrEqualTo
larger = LargerThan(FirstNumber=crv_cp.Parameter, SecondNumber="1-1e-3")  # -> LargerThan, OrEqualTo
or = GateOr(A=larger.LargerThan, B=smaller_2.SmallerThan)
not = GateNot(A=or)
and = GateAnd(A=not, B=smaller.SmallerThan)  # -> simplify(Result)
parameters = Number(simplify(crv_cp.Parameter))
path_mapper = PathMapper(and, source="{A}(B)", target="{B}(A)")
path_mapper_2 = PathMapper(parameters, source="{A}(B)", target="{B}(A)")
cull = CullPattern(List=simplify(path_mapper_2), CullPattern=simplify(path_mapper))
any = AnyTrue(values=path_mapper)  # -> flatten(any_true)
shatter = Shatter(Curve=reparameterize(graft(crv)), Parameters=cull)
not_2 = GateNot(A=any)
cull_2 = CullPattern(List=simplify(crv), CullPattern=not_2)
shattered_curves = Curve(shatter)
curves_to_keep = Curve(cull_2)
merge = Merge(Data1=flatten(shattered_curves), Data2=flatten(curves_to_keep))  # -> flatten(Result)
crv_2 = Curve(merge)

crv_3 = ClusterOutput(crv_2)

# ==== cluster OffsetByTheAverageDistanceField: Offset closed boundary curves (Naked edges) with the average of the distance field for each set of points
C = ClusterInput()
G = ClusterInput()

# ----
# Offset by average distance field
explode = Explode(Curve=C, Recursive=True)  # -> Segments, Vertices
curvepoint = PointOnCurve(explode.Segments, parameter=0.5)
pull = PullPoint(Point=curvepoint, Geometry=flatten(G), ClosestOnly=True)  # -> ClosestPoint, Distance
join = JoinCurves(Curves=explode.Segments, Preserve=False)
ma = MassAddition(Input=pull.Distance)  # -> Result, PartialResults
lng = ListLength(List=pull.Distance)
division = Division(A=ma.Result, B=lng)
offset = OffsetCurve(Curve=join, Distance=expr("x*-1", division), Plane=PlaneXY(0, 0, 0), Corners=1)
offset_2 = OffsetCurve(Curve=join, Distance=division, Plane=PlaneXY(0, 0, 0), Corners=1)
larger = LargerThan(FirstNumber=offset, SecondNumber=offset_2)  # -> LargerThan, OrEqualTo
smaller = SmallerThan(FirstNumber=offset, SecondNumber=offset_2)  # -> SmallerThan, OrEqualTo
cull = CullPattern(List=offset, CullPattern=larger.LargerThan)
cull_2 = CullPattern(List=offset_2, CullPattern=smaller.SmallerThan)
flip = FlipCurve(Curve=cull)  # -> Curve, Flag

L = ClusterOutput([cull_2, flip.Curve])

# ==== cluster SurfaceFromPointTrail: Creates a surface by creating a closed polyline through the points in order.
sorted_culled_points = ClusterInput()

# ----
# Create Surface
sorted_culled_points_2 = Point(sorted_culled_points)
pline = PolyLine(Vertices=sorted_culled_points_2, Closed=True)
join = JoinCurves(Curves=pline, Preserve=False)
boundary = BoundarySurfaces(Edges=join)
room_surfaces = Data(boundary)

room_surfaces_2 = ClusterOutput(room_surfaces)

# ==== cluster RemoveGroupsOutsideGeometry
corner_points = ClusterInput()
grouped_points = ClusterInput()

# ----
# Remove groups of points containing corners
corner_points_2 = Point(flatten(corner_points))
grouped_points_2 = Point(grouped_points)
lng = ListLength(List=grouped_points_2)
intersection = SetIntersection(SetA=corner_points_2, SetB=grouped_points_2)
lng_2 = ListLength(List=intersection)
larger = LargerThan(FirstNumber=lng, SecondNumber=Slider(30, range=0..100))  # -> LargerThan, OrEqualTo
equals = Equality(FirstNumber=lng_2, SecondNumber=Slider(0, range=0..100))  # -> Equality, Inequality
and = GateAnd(A=equals.Equality, B=larger.LargerThan)
cull = CullPattern(List=grouped_points_2, CullPattern=and)
clean = CleanTree(RemoveNulls=True, RemoveInvalid=True, RemoveEmpty=True, Tree=cull)
grouped_points_3 = Point(clean)

grouped_points_4 = ClusterOutput(grouped_points_3)

# ==== cluster RemovePointsNearWalls
point_grid = ClusterInput()
floor_plan = ClusterInput()
threshold = ClusterInput()

# ----
# Cull points closer than threshold to walls
point_grid_2 = Point(point_grid)
floor_plan_2 = Curve(floor_plan)
pull = PullPoint(Point=point_grid_2, Geometry=simplify(floor_plan_2), ClosestOnly=True)  # -> ClosestPoint, Distance
flip = FlipMatrix(Data=pull.Distance)
sort = SortList(Keys=flip)  # -> Keys, ValuesA
item = ListItem(List=sort.Keys, Index=0, Wrap=True)  # -> flatten(Item)
threshold_2 = Data(threshold)
larger = LargerThan(FirstNumber=item, SecondNumber=threshold_2)  # -> LargerThan, OrEqualTo
cull = CullPattern(List=point_grid_2, CullPattern=larger.LargerThan)
modified_point_grid = Point(cull)

modified_point_grid_2 = ClusterOutput(modified_point_grid)

# ==== cluster PointsGroupedInRooms
modified_point_grid = ClusterInput()
cell_size = ClusterInput()

# ----
# Grouping points and proximity
cell_size_2 = Data(cell_size)
modified_point_grid_2 = Point(modified_point_grid)
expression = Expression(a=cell_size_2, Expression="sqrt(a^2+a^2)+0.01")
pgroups = PointGroups(Points=modified_point_grid_2, Distance=expression)  # -> simplify(Groups), Indices
grouped_points = Point(pgroups.Groups)

grouped_points_2 = ClusterOutput(grouped_points)

# ==== cluster PullNakedEdgeVertices
room_boundaries = ClusterInput()
floor_plan = ClusterInput()

# ----
# Pull concave verticies to nearest floor plan geometry
room_boundaries_2 = Curve(room_boundaries)
floor_plan_2 = Curve(floor_plan)
simplify = SimplifyCurve(Curve=room_boundaries_2)  # -> Curve, Simplified
explode = Explode(Curve=simplify.Curve, Recursive=True)  # -> Segments, Vertices
pull = PullPoint(Point=explode.Vertices, Geometry=flatten(floor_plan_2), ClosestOnly=True)  # -> ClosestPoint, Distance
closest_points = Point(pull.ClosestPoint)

closest_points_2 = ClusterOutput(closest_points)

# ==== cluster PullClosestPoints2Corners
closest_points = ClusterInput()

# ----
# Cull points with an angle larger than 170 degrees
closest_points_2 = Point(closest_points)
cullpt = CullDuplicates(Points=closest_points_2, Tolerance=0.1, CullMode=3)  # -> Points, Indices, Valence
shift = ShiftList(List=cullpt.Points, Shift=-1, Wrap=True)
shift_2 = ShiftList(List=cullpt.Points, Shift=1, Wrap=True)
vec2pt = Vector2Pt(PointA=cullpt.Points, PointB=shift_2, Unitize=False)  # -> Vector, Length
vec2pt_2 = Vector2Pt(PointA=cullpt.Points, PointB=shift, Unitize=False)  # -> Vector, Length
angle = Angle(VectorA=vec2pt.Vector, VectorB=vec2pt_2.Vector)  # -> Angle, Reflex
deg = Degrees(Radians=angle.Angle)
smaller = SmallerThan(FirstNumber=deg, SecondNumber=Slider(170, range=0..1000))  # -> SmallerThan, OrEqualTo
cull = CullPattern(List=cullpt.Points, CullPattern=smaller.SmallerThan)
points_pulled_onto_floor_plan = Point(cullpt.Points)
corner_points_to_replace = Point(cull)

shatted_wall_lines = ClusterInput()

# ----
# Replace closest "corner" points with end points
points_pulled_onto_floor_plan_2 = Point(points_pulled_onto_floor_plan)
corner_points_to_replace_2 = Point(corner_points_to_replace)
shatted_wall_lines_2 = Curve(shatted_wall_lines)
end = EndPoints(Curve=shatted_wall_lines_2)  # -> Start, End

# ----
# Remove points farthest moved to same point
cullpt_2 = CullDuplicates(Points=[end.Start, end.End], Tolerance=5, CullMode=3)  # -> Points, Indices, Valence

cp = ClosestPoint(Point=corner_points_to_replace_2, Cloud=cullpt_2.Points)  # -> ClosestPoint, CPIndex, Distance

removepointsfarthestmoved2samepoint = GhPythonScript(x=cp.CPIndex, y=cp.Distance)  # -> out, a; inputs x: list, y: list
# ---------- removepointsfarthestmoved2samepoint: Python ----------
# Creates a cull pattern starts with everything true.
# If any two indecies of the closest point is the same
# the point farthest away is set to false 
mapping = [True] * len(x)
for i, elem in enumerate(x):
    try:
        j = x.index(elem, i + 1)  # look ahead
        mapping[i] = y[i]<y[j]
        mapping[j] = y[j]<y[i]
    except ValueError: # no match found
        pass
a = mapping
# ---------- end removepointsfarthestmoved2samepoint ----------
cull_2 = CullPattern(List=cp.ClosestPoint, CullPattern=removepointsfarthestmoved2samepoint.a)
cull_3 = CullPattern(List=corner_points_to_replace_2, CullPattern=removepointsfarthestmoved2samepoint.a)

replace = ReplaceMembers(Set=points_pulled_onto_floor_plan_2, Find=cull_3, Replace=cull_2)
sorted_culled_points = Point(replace)

sorted_culled_points_2 = ClusterOutput(sorted_culled_points)

# ==== cluster AnyTrue: Returns True if any input value is True
values = ClusterInput()
ma = MassAddition(Input=values)  # -> Result, PartialResults
larger = LargerThan(FirstNumber=ma.Result, SecondNumber=Slider(1, range=0..1))  # -> LargerThan, simplify(OrEqualTo)
any_true = ClusterOutput(larger.OrEqualTo)
