# Grasshopper definition concave_hull.gh (Grasshopper 1.0.7)

current_directory = GhPythonScript()  # -> dir
# ---------- current_directory: Python ----------
import Grasshopper
path = Grasshopper.Instances.ActiveCanvas.Document.FilePath
dir = "\\".join(path.split("\\")[:-1])+"\\"
# ---------- end current_directory ----------
concat = Concatenate(FragmentA=current_directory, FragmentB="concave_hull.py")
roomed_points = Point(Tree({1}: [Point(36.16662126, 69.8953542, 0), Point(36.16662126, 69.5953542, 0), Point(35.86662126, 69.8953542, 0), Point(35.86662126, 69.5953542, 0), Point(36.16662126, 69.2953542, 0), Point(35.86662126, 69.2953542, 0)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], {2}: [Point(34.06662126, 66.2953542, 0), Point(33.76662126, 66.2953542, 0), Point(33.46662126, 66.5953542, 0), Point(33.46662126, 66.2953542, 0), Point(33.16662126, 66.5953542, 0), Point(33.16662126, 66.2953542, 0)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], {3}: [Point(32.86662126, 63.2953542, 0), Point(32.86662126, 62.9953542, 0), Point(32.56662126, 63.2953542, 0), Point(32.56662126, 62.9953542, 0), Point(32.86662126, 62.6953542, 0), Point(32.56662126, 62.6953542, 0)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], {4}: [Point(23.56662126, 68.9953542, 0), Point(23.56662126, 68.6953542, 0), Point(23.26662126, 68.9953542, 0), Point(23.26662126, 68.6953542, 0), Point(23.56662126, 68.3953542, 0), Point(23.26662126, 68.3953542, 0)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], {5}: [Point(22.96662126, 65.6953542, 0), Point(22.66662126, 65.9953542, 0), Point(22.66662126, 65.6953542, 0), Point(22.36662126, 65.9953542, 0), Point(22.36662126, 65.6953542, 0), Point(22.06662126, 66.2953542, 0)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], {6}: [Point(18.46662126, 63.8953542, 0), Point(18.16662126, 64.1953542, 0), Point(18.16662126, 63.8953542, 0), Point(17.86662126, 64.4953542, 0), Point(17.86662126, 64.1953542, 0), Point(17.86662126, 63.8953542, 0)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]))
file = ReadFile(File=concat, PerLineParse=False)
concavehull = PythonScript(Code=file, Pts=roomed_points, Factor=Slider(0.5, range=0..1))  # -> Out, ConcaveHull
concave_curves = Curve(concavehull.ConcaveHull)
