# Grasshopper definition floor_plan.gh (Grasshopper 1.0.7)

current_directory = GhPythonScript()  # -> dir
# ---------- current_directory: Python ----------
import Grasshopper
path = Grasshopper.Instances.ActiveCanvas.Document.FilePath
dir = "\\".join(path.split("\\")[:-1])+"\\"
# ---------- end current_directory ----------
concat = Concatenate(FragmentA=current_directory, FragmentB="floor_plan.py")
geometry = Data([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])
file = ReadFile(File=concat, PerLineParse=False)
floor_plan = GhPythonScript(Code=file, Geometry=geometry, Height=Slider(500, range=0..1000))  # -> Out, A
floor_plan_2 = Curve(floor_plan.A)
