# Grasshopper definition room_connectivity.gh (Grasshopper 1.0.7)

current_directory = GhPythonScript()  # -> dir
# ---------- current_directory: Python ----------
import Grasshopper
path = Grasshopper.Instances.ActiveCanvas.Document.FilePath
dir = "\\".join(path.split("\\")[:-1])+"\\"
# ---------- end current_directory ----------
sample_distance = Slider(1000, range=200..5000)
concat = Concatenate(FragmentA=current_directory, FragmentB="room_connectivity.py")
file = ReadFile(File=concat, PerLineParse=False)
srf = Surface([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])
connectivity = GhPythonScript(Code=file, Rooms=srf, Distance=Slider(706, range=0..1000), Sample=sample_distance)  # -> Out, Connectivity

# ----
# Room tags
area = Area(Geometry=srf)  # -> Area, Centroid
lng = ListLength(List=area.Centroid)
series = Series(Start=0, Step=1, Count=lng)
tag = TextTag(Location=area.Centroid, Text=series)

panel = Panel(connectivity.Connectivity)
