# Grasshopper definition particles.gh (Grasshopper 1.0.7)
# plug-ins: FlexHopper

number_slider = Slider(20, range=0..100)
number_slider_2 = Slider(0.1, range=0..0.1)
dom = ConstructDomain(DomainStart=0, DomainEnd=Slider(0.2, range=0..1))
random = Random(Range=dom, Number=number_slider, Seed=2)
random_2 = Random(Range=dom, Number=number_slider, Seed=2)
subtraction = Subtraction(A=Slider(0.9, range=0..1), B=number_slider_2)
# Ray-wall distance threshold
distance_threshold = Slider(0.15, range=0..1)
# Number of Rays
number_of_rays = Slider(8, range=0..100)
# Single point location
md_slider = MDSlider(
    SliderMode=0,
    slider_value=Point(0.7292884734, 0.8617386236, 0.5),
    x_domain=Domain(0, 1),
    y_domain=Domain(0, 1),
    z_domain=Domain(0, 1))
Y = UnitY(Factor=random_2)
X = UnitX(Factor=random)
list = ValueList({"Single Point": 0, "Point Array": 1}, selected="Point Array")
# Point Grid Cell Size
cell_size = Slider(0.5, range=0..10)
division = Division(A=subtraction, B=number_slider)
series = Series(Start=number_slider_2, Step=division, Count=number_slider)
Z = UnitZ(Factor=graft(series))
# Building Mesh
mesh = Mesh([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])
addition = Addition(A=Z, B=graft(X), C=graft(Y))
neg = Negative(Value=Slider(1, range=0..1))
Z_2 = UnitZ(Factor=neg)
fluid_rest_distance = Slider(0.5, range=0.5..0.7)
Z_3 = UnitZ(Factor=Slider(0.001, range=0..0.1))
radius = Slider(0.1, range=0..1)
neg_2 = Negative(Value=Z_3)
radius_2 = Slider(0.45, range=0..1)
Z_4 = UnitZ(Factor=Slider(3, range=0..10))
xy = XYPlane(Origin=Point(0, 0, 0))
multiplication = Multiplication(A=radius, B=fluid_rest_distance)
parameters = FlexParametersFromValues(
    Gravity=Vector(0, 0, -9.81),
    Radius=radius,
    SolidRestDistance=multiplication,
    FluidRestDistance=multiplication,
    CollisionDistance=0.075,
    ParticleCollisionMargin=0.5,
    ShapeCollisionMargin=0.5,
    MaxSpeed=3.402823466e+38,
    MaxAcceleration=100,
    DynamicFriction=0,
    StaticFriction=0,
    ParticleFriction=0,
    Restitution=0,
    Adhesion=0,
    SleepThreshold=0,
    ShockPropagation=0,
    Dissipation=radius_2,
    Damping=0,
    Fluid=True,
    Viscosity=0,
    Cohesion=0.025,
    SurfaceTension=0,
    SolidPressure=1,
    FreeSurfaceDrag=0,
    Buoyancy=1,
    PlasticThreshold=0,
    PlasticCreep=0,
    Wind=Vector(0, 0, 0),
    Drag=0,
    Lift=0,
    RelaxationMode=True,
    RelaxationFactor=1)
opts = FlexSolverOptions(
    TimeStep=Slider(0.2, range=0..1),
    SubSteps=3,
    NumIterations=3,
    SceneMode=0,
    FixedNumberOfIteration=-1,
    MemoryRequirements=[131072, 96, 65536, 65536, 65536, 65536, 65536, 196608, 131972],
    StabilityScale=1)
distance_threshold_2 = Number(distance_threshold)

# ----
# Plantegning
number_slider_3 = Slider(1, range=0..10)
mesh_2 = Mesh(mesh)
pt = ConstructPoint(XCoordinate=0, YCoordinate=0, ZCoordinate=number_slider_3)
xy_2 = XYPlane(Origin=pt)
sec = MeshPlane(Mesh=mesh_2, Plane=xy_2)
xy_3 = XYPlane(Origin=Point(0, 0, 0))
project = Project(Geometry=sec, Plane=xy_3)  # -> Geometry, Transform
clean = CleanTree(RemoveNulls=True, RemoveInvalid=True, RemoveEmpty=True, Tree=project.Geometry)

wall_lines = Line(clean)
wall_lines_2 = Line(clean)
# Clean up
crv = Curve(reparameterize(simplify(flatten(wall_lines_2))))
python = GhPythonScript(wall_curves=crv, threshold=distance_threshold_2)  # -> out, flatten(a); inputs wall_curves: tree of Curve
# ---------- python: Python ----------
import rhinoscriptsyntax as rs
import ghpythonlib.components as gh
from Rhino.Geometry import Curve, Point, Vector3d, Line, Interval


def dataTreeToList(aTree):
    from Grasshopper import DataTree
    from Grasshopper.Kernel.Data import GH_Path
    theList = []
    for i in range(aTree.BranchCount ):
        thisListPart = []
        thisBranch = aTree.Branch(i)
        for j in range(len(thisBranch)):
            thisListPart.append( thisBranch[j] )
        theList.append(thisListPart)
    return theList

def raggedListToDataTree(raggedList):
    from Grasshopper import DataTree
    from Grasshopper.Kernel.Data import GH_Path
    rl = raggedList
    result = DataTree[object]()
    for i in range(len(rl)):
        temp = []
        for j in range(len(rl[i])):
            temp.append(rl[i][j])
        path = GH_Path(i)
        result.AddRange(temp, path)
    return result

def ends_in_point(curve, point):
    d0 = gh.Distance(curve.PointAt(0.0),point)
    d1 = gh.Distance(curve.PointAt(1.0),point)
    if d0 == 0 or d1 == 0:
        return True
    else:
        return False

wall_curves = dataTreeToList(wall_curves)[0]


directions = [-1, 1]
wc_copy = list(wall_curves)
for j,curve in enumerate(wc_copy):
    for i,parameter in enumerate([0, 1]):
        p = curve.PointAt(parameter)
        v = curve.TangentAt(parameter)*directions[i]
        ray = gh.LineSDL(p,v,threshold)
        
        #Make obstacle list for ray
        obstacles = []
        for c in wall_curves:
            if not ends_in_point(c,p):
                obstacles.append(c)
        
        # Isovist
        iso_p, iso_d, iso_i = gh.IsoVistRay(ray,threshold,obstacles)
        
        if iso_i == -1 or iso_i == None:
            continue
        other_curve = wall_curves[iso_i]
        
        #Extend to point
        if parameter == 0:
            extended_curve = gh.ExtendCurve(curve, 0, start=iso_d, end=0)
        elif parameter == 1:
            extended_curve = gh.ExtendCurve(curve, 0, start=0, end=iso_d)
        wall_curves.pop(j)
        extended_curve.Domain = Interval(0.0,1.0)
        wall_curves.append(extended_curve)
        
        # Shatter at intersection´
        _, shatter_param, _ = gh.CurveClosestPoint(iso_p,other_curve)
        if round(shatter_param,12) not in [0.0, 1.0]:
            shatter_pieces = gh.Shatter(other_curve,shatter_param)
            wall_curves.pop(iso_i)
            wall_curves.extend(shatter_pieces)

bla = list()
for i in wall_curves:
    bla.append([i])               

a = raggedListToDataTree(bla)
# ---------- end python ----------
wall_lines_3 = Line(flatten(python.a))
move = Move(Geometry=wall_lines_3, Motion=Z_2)  # -> Geometry, Transform
extr = Extrude(Base=move.Geometry, Direction=Z_4)
mesh_3 = Mesh(extr)
collgeometry = FlexCollisionGeometry(CollisionPlanes=flatten(xy), CollisionMeshes=flatten(mesh_3))

wall_lines_4 = Line(flatten(python.a))

# ----
# Extreme points
wall_lines_5 = Line(flatten(wall_lines_4))
bbox = BoundingBox(Content=wall_lines_5, Plane=PlaneXY(0, 0, 0), UnionBox=True)  # -> Box, Box_2
box = EvaluateBox(Box=bbox.Box, UParameter=1, VParameter=1, WParameter=1)  # -> Plane, Point, Include
debox = DeconstructBox(Box=bbox.Box)  # -> Plane, X, Y, Z
dedomain = DeconstructDomain(Domain=debox.X)  # -> Start, End
dedomain_2 = DeconstructDomain(Domain=debox.Y)  # -> Start, End
dedomain_3 = DeconstructDomain(Domain=debox.Z)  # -> Start, End
vlen = VectorLength(Vector=box.Point)
min_x = Number(dedomain.Start)
max_x = Number(dedomain.End)
min_y = Number(dedomain_2.Start)
max_y = Number(dedomain_2.End)
min_z = Number(dedomain_3.Start)
max_z = Number(dedomain_3.End)
longest_distance = Number(vlen)

# ----
# Point Grid
min_x_2 = Number(min_x)
min_y_2 = Number(min_y)
min_z_2 = Number(min_z)
max_x_2 = Number(max_x)
max_y_2 = Number(max_y)
max_z_2 = Number(max_z)
cell_size_2 = Number(cell_size)
subtraction_2 = Subtraction(A=max_x_2, B=min_x_2)
subtraction_3 = Subtraction(A=max_y_2, B=min_y_2)
subtraction_4 = Subtraction(A=max_z_2, B=min_z_2)
vec = VectorXYZ(XComponent=cell_size_2, YComponent=cell_size_2, ZComponent=cell_size_2)  # -> Vector, Length
pt_2 = ConstructPoint(XCoordinate=min_x_2, YCoordinate=min_y_2, ZCoordinate=min_z_2)
move_2 = Move(Geometry=pt_2, Motion=vec.Vector)  # -> Geometry, Transform
division_2 = Division(A=subtraction_2, B=cell_size_2)
division_3 = Division(A=subtraction_3, B=cell_size_2)
division_4 = Division(A=subtraction_4, B=cell_size_2)
round = Round(Number=division_2)  # -> Nearest, Floor, Ceiling
round_2 = Round(Number=division_3)  # -> Nearest, Floor, Ceiling
round_3 = Round(Number=division_4)  # -> Nearest, Floor, Ceiling
box_2 = Box2Pt(PointA=pt_2, PointB=move_2.Geometry, Plane=PlaneXY(0, 0, 0))
addition_2 = Addition(A=round.Ceiling, B=1)
addition_3 = Addition(A=round_2.Ceiling, B=1)
addition_4 = Addition(A=round_3.Ceiling, B=1)
arrbox = BoxArray(Geometry=pt_2, Cell=box_2, XCount=round.Ceiling, YCount=round_2.Ceiling, ZCount=addition_4)  # -> Geometry, Transform
point_grid = Point(arrbox.Geometry)

# ----
# Frasorterer punkter for tæt på vægge
distance_threshold_3 = Number(distance_threshold)
point_grid_2 = Point(point_grid)
wall_lines_6 = Line(wall_lines_4)
crv_cp = CurveClosestPoint(Point=point_grid_2, Curve=graft(wall_lines_6))  # -> Point, Parameter, Distance
flip = FlipMatrix(Data=crv_cp.Distance)
sort = SortList(Keys=flip)  # -> Keys, ValuesA
item = ListItem(List=sort.Keys, Index=0, Wrap=True)  # -> flatten(Item)
larger = LargerThan(FirstNumber=item, SecondNumber=distance_threshold_3)  # -> LargerThan, OrEqualTo
cull = CullPattern(List=point_grid_2, CullPattern=larger.LargerThan)
cull_pattern = Boolean(larger.LargerThan)
point_grid_3 = Point(cull)

move_3 = Move(Geometry=point_grid_3, Motion=addition)  # -> Geometry, Transform
particles = ParticlesFromPoints(
    Points=move_3.Geometry,
    Velocities=neg_2,
    Masses=Slider(0.01, range=0..0.1),
    SelfCollision=Toggle(True),
    IsFluid=Toggle(True),
    GroupIndex="0")
scene = FlexScene(Particles=flatten(particles))
flex = FlexEngine(
    FlexParams=parameters,
    FlexCollisionGeometry=collgeometry,
    FlexScene=flatten(scene),
    FlexSolverOptions=opts,
    Reset=Button(),
    Go=Toggle(True))  # -> FlexObject, Information

# ----
# Single Point
md_picker = Point(md_slider)
wall_lines_7 = Line(flatten(wall_lines_4))
end = EndPoints(Curve=wall_lines_7)  # -> Start, End
sort_pt = SortPoints(Points=flatten([end.Start, end.End]))  # -> Points, Indices
item_2 = ListItem(List=sort_pt.Points, Index=0, Wrap=True)  # -> Item1, Item
multiplication_2 = Multiplication(A=md_picker, B=item_2.Item1)
isovist_point = Point(multiplication_2)

allparts = GetAllParticles(FlexObject=flex.FlexObject, N=Slider(1, range=0..1))  # -> Points, Vector

# ----
# Bottom mesh
min_y_3 = Number(min_y)
max_x_3 = Number(max_x)
max_z_3 = Number(max_z)
min_x_3 = Number(min_x)
min_z_3 = Number(min_z)
max_y_3 = Number(max_y)
pt_3 = ConstructPoint(XCoordinate=max_x_3, YCoordinate=max_y_3, ZCoordinate=max_z_3)
pt_4 = ConstructPoint(XCoordinate=min_x_3, YCoordinate=min_y_3, ZCoordinate=min_z_3)
rec_2pt = Rectangle2Pt(Plane=PlaneXY(0, 0, 0), PointA=pt_4, PointB=pt_3, Radius=0)  # -> Rectangle, Length
boundary = BoundarySurfaces(Edges=rec_2pt.Rectangle)
bottom_mesh = Mesh(boundary)

cloud = CloudDisplay(
    Points=allparts.Points,
    Colours=ColourSwatch(SwatchColor=RGB(255, 255, 255)),
    Size=Slider(0.063, range=0..0.2),
    SpriteType=1)
